# Dynamo graph ChatGPT-4 Python Code create project model.dyn "_ChatGPT-4 Python Code create project model" (Dynamo 2.17.0.3472)

create_views_for_mechanical = Python()  # "Create views for mechanical, electrical, and plumbing"; CPython3; unwired: IN[0]
# ---------- create_views_for_mechanical.python (40 lines) ----------
import clr

# Import RevitAPI
clr.AddReference('RevitAPI')
from Autodesk.Revit.DB import *

# Import DocumentManager and TransactionManager
clr.AddReference('RevitServices')
from RevitServices.Persistence import DocumentManager
from RevitServices.Transactions import TransactionManager

# Get the current document
doc = DocumentManager.Instance.CurrentDBDocument

# Start a new transaction
TransactionManager.Instance.EnsureInTransaction(doc)

# Define the disciplines and their prefixes
disciplines = {"Mechanical": "M", "Electrical": "E", "Plumbing": "P"}

# Retrieve all levels in the project
collector = FilteredElementCollector(doc)
levels = collector.OfClass(Level).ToElements()

# Retrieve the ViewFamilyType for FloorPlan views
view_family_types = FilteredElementCollector(doc).OfClass(ViewFamilyType).ToElements()
for vft in view_family_types:
    if vft.ViewFamily == ViewFamily.FloorPlan:
        floor_plan_view_family_type = vft
        break

# Create views for each discipline at each level
for level in levels:
    for discipline, prefix in disciplines.items():
        view_name = f"{prefix}_{level.Name}_{discipline}"
        view_plan = ViewPlan.Create(doc, floor_plan_view_family_type.Id, level.Id)
        view_plan.Name = view_name

# End the transaction
TransactionManager.Instance.TransactionTaskDone()
# ----------------------------------------
generate_grids = Python()  # CPython3; unwired: IN[0]
# ---------- generate_grids.python (35 lines) ----------
import clr

# Import RevitAPI
clr.AddReference('RevitAPI')
from Autodesk.Revit.DB import *

# Import DocumentManager and TransactionManager
clr.AddReference('RevitServices')
from RevitServices.Persistence import DocumentManager
from RevitServices.Transactions import TransactionManager

# Get the current document
doc = DocumentManager.Instance.CurrentDBDocument

# Start a new transaction
TransactionManager.Instance.EnsureInTransaction(doc)

# Define the grid line names and positions
numbered_grids = list(range(1, 11))  # This will create grids 1-10
lettered_grids = list('ABCDEFGHIJ')  # This will create grids A-J

# Create the numbered grids
for i, number in enumerate(numbered_grids, start=1):
    line = Line.CreateBound(XYZ(i*10, 0, 0), XYZ(i*10, 100, 0))  # Adjust the coordinates as necessary
    grid = Grid.Create(doc, line)
    grid.Name = str(number)

# Create the lettered grids
for i, letter in enumerate(lettered_grids, start=1):
    line = Line.CreateBound(XYZ(0, i*10, 0), XYZ(100, i*10, 0))  # Adjust the coordinates as necessary
    grid = Grid.Create(doc, line)
    grid.Name = letter

# End the transaction
TransactionManager.Instance.TransactionTaskDone()
# ----------------------------------------
place_the_new_views_on_sheets = Python()  # CPython3; unwired: IN[0]
# ---------- place_the_new_views_on_sheets.python (39 lines) ----------
import clr

# Import RevitAPI
clr.AddReference('RevitAPI')
from Autodesk.Revit.DB import *

# Import DocumentManager and TransactionManager
clr.AddReference('RevitServices')
from RevitServices.Persistence import DocumentManager
from RevitServices.Transactions import TransactionManager

# Get the current document
doc = DocumentManager.Instance.CurrentDBDocument

# Start a new transaction
TransactionManager.Instance.EnsureInTransaction(doc)

# Retrieve all view plans in the project
collector = FilteredElementCollector(doc)
view_plans = collector.OfClass(ViewPlan).ToElements()

# Retrieve the first title block in the model
title_blocks = FilteredElementCollector(doc).OfClass(FamilySymbol).WhereElementIsElementType().ToElements()
title_block_type = next((tb for tb in title_blocks if tb.Category.Name == 'Title Blocks'), None)

if title_block_type is None:
    raise Exception("Could not find a title block in the model.")

# Create sheets and place views
for i, view in enumerate(view_plans, start=1):
    sheet_number = f"{i:03d}"  # Pad with zeros to a width of 3 digits
    sheet = ViewSheet.Create(doc, title_block_type.Id)
    sheet.SheetNumber = sheet_number
    sheet.Name = view.Name

    viewport = Viewport.Create(doc, sheet.Id, view.Id, XYZ.Zero)

# End the transaction
TransactionManager.Instance.TransactionTaskDone()
# ----------------------------------------
create_five_levels = Python()  # CPython3; unwired: IN[0]
# ---------- create_five_levels.python (30 lines) ----------
import clr

# Import RevitAPI
clr.AddReference('RevitAPI')
from Autodesk.Revit.DB import *

# Import DocumentManager and TransactionManager
clr.AddReference('RevitServices')
from RevitServices.Persistence import DocumentManager
from RevitServices.Transactions import TransactionManager

# Get the current document
doc = DocumentManager.Instance.CurrentDBDocument

# Start a new transaction
TransactionManager.Instance.EnsureInTransaction(doc)

# Create five levels
level_names = ["Level 1", "Level 2", "Level 3", "Level 4", "Level 5"]
level_heights = [0.0, 10.0, 20.0, 30.0, 40.0]  # Heights in feet

for name, height in zip(level_names, level_heights):
    level = Level.Create(doc, height)
    level.Name = name

# End the transaction
TransactionManager.Instance.TransactionTaskDone()

# Return the levels
OUT = level_names
# ----------------------------------------
