# Dynamo graph Pipe_Duct_Insulation.dyn (Dynamo 2.18.1.5096)

code_block = CodeBlock { ["Ducts","Duct Fittings"]; }
byName = Category.ByName(name=code_block)
all_elements_of_category = ElementsOfCategory(Category=byName)
flatten = List.Flatten(list=all_elements_of_category)
identity = Object.Identity(object=flatten)
element_types = ElementTypes("DuctInsulationType")
all_elements_of_type = ElementsOfType(element_class=element_types)
name = Element.Name(element=all_elements_of_type)
byKeysValues = DesignScript.Builtin.Dictionary.ByKeysValues(keys=name, values=all_elements_of_type)
code_block_2 = CodeBlock { " "; }
file_path = Filename(".\Insulations.csv")
importCSV = Data.ImportCSV(filePath=file_path)
code_block_3 = CodeBlock { 1; }
code_block_4 = CodeBlock(x=importCSV) { x[1]; }
code_block_5 = CodeBlock { 0; 1; }
remove = String.Remove(string=code_block_4, startIndex=code_block_5.out0, count=code_block_5.out1)
code_block_6 = CodeBlock { -1; }
remove_2 = String.Remove(string=remove, startIndex=code_block_6, count=code_block_6)
code_block_7 = CodeBlock { "\"\""; "\""; }
replace = String.Replace(string=remove_2, searchFor=code_block_7.out0, replaceWith=code_block_7.out1)
replaceItemAtIndex = List.ReplaceItemAtIndex(list=importCSV, index=code_block_3, item=replace)
code_block_8 = CodeBlock { 1; }
dropItems = List.DropItems(list=replaceItemAtIndex@L2, amount=code_block_8)
code_block_9 = CodeBlock(x=dropItems) { [x[0],x[1]]; }
transpose = List.Transpose(lists=code_block_9)
join = String.Join(separator=code_block_2, string0=transpose)
flatten_2 = List.Flatten(list=join)
code_block_10 = CodeBlock(x=dropItems) { [x[2],x[3]]; }
transpose_2 = List.Transpose(lists=code_block_10)
byKeysValues_2 = DesignScript.Builtin.Dictionary.ByKeysValues(keys=flatten_2, values=transpose_2)
code_block_11 = CodeBlock { " "; }
code_block_12 = CodeBlock { "System Classification"; }
getParameterValueByName = Element.GetParameterValueByName(element=flatten, parameterName=code_block_12)
code_block_13 = CodeBlock { "Size"; }
getParameterValueByName_2 = Element.GetParameterValueByName(element=flatten, parameterName=code_block_13)
list_create = List.Create(item0=getParameterValueByName, item1=getParameterValueByName_2)
transpose_3 = List.Transpose(lists=list_create)
join_2 = String.Join(separator=code_block_11, string0=transpose_3)
flatten_3 = List.Flatten(list=join_2)
code_block_14 = CodeBlock { "ø"; ""; }
replace_2 = String.Replace(string=flatten_3, searchFor=code_block_14.out0, replaceWith=code_block_14.out1)
valueAtKey = DesignScript.Builtin.Dictionary.ValueAtKey(dictionary=byKeysValues_2, key=replace_2)
firstItem = List.FirstItem(list=valueAtKey@L2)
valueAtKey_2 = DesignScript.Builtin.Dictionary.ValueAtKey(dictionary=byKeysValues, key=firstItem)
lastItem = List.LastItem(list=valueAtKey@L2)
code_block_15 = CodeBlock(num=lastItem) { num / 12; }
python_script = Python(IN[0]=identity, IN[1]=valueAtKey_2, IN[2]=code_block_15)  # CPython3
# ---------- python_script.python (63 lines) ----------
#The BIM Coordinators Dynamo Python Template
#Subscribe to my YouTube: https://www.youtube.com/c/TheBIMCoordinator/featured
#Follow my on LinkedIn: https://www.linkedin.com/in/dalton-goodwin-067a07107/

"""
Dynamo Core Assemblies: 
https://www.nuget.org/packages/DynamoVisualProgramming.Core/2.13.1.3887

Revit API: 
https://www.revitapidocs.com/2020/d4648875-d41a-783b-d5f4-638df39ee413.htm
"""

"""
C:\Program Files\Autodesk\Revit 2022\AddIns\DynamoForRevit

C:\Program Files\Autodesk\Revit 2022\AddIns\DynamoForRevit\Revit

"""


import sys
import clr


clr.AddReference('RevitAPI')
from Autodesk.Revit.DB.Mechanical import DuctInsulation



import RevitServices
from RevitServices.Persistence import DocumentManager
from RevitServices.Transactions import TransactionManager

doc = DocumentManager.Instance.CurrentDBDocument
uidoc=DocumentManager.Instance.CurrentUIApplication.ActiveUIDocument

#Preparing input from dynamo to revit
duct_elements = UnwrapElement(IN[0])
duct_insulations = UnwrapElement(IN[1])
insulation_thickness = IN[2]





#apply correct function depending on element
#check if element is of the correct category

#system type, diameter, system classification
    #Do some action in a Transaction
TransactionManager.Instance.EnsureInTransaction(doc)
for duct, duct_insulation, in_thickness in zip(duct_elements, duct_insulations, insulation_thickness):
    if duct_insulation != None:
        DuctInsulation.Create(doc,duct.Id,duct_insulation.Id, in_thickness)








TransactionManager.Instance.TransactionTaskDone()
# ----------------------------------------
