# Dynamo graph Update Views to Saved Location.dyn (Dynamo 2.19.3.6394)

code_block = CodeBlock { "Viewports"; }
byName = Category.ByName(name=code_block)
all_elements_of_category = ElementsOfCategory(Category=byName)
grab_views_that_have_scope_boxes = Python(IN[0]=all_elements_of_category)  # CPython3
# ---------- grab_views_that_have_scope_boxes.python (44 lines) ----------
"""
1. Create and name a new schema
2. Set the read/write access for the schema
3. Define one or more fields of data for the schema
4. Create an entity based on the schema
5. Assign values to the fields for the entity
6. Associate the entity with a Revit element
"""
#import sys
import sys
import os
import uuid
import clr
clr.AddReference('RevitAPI')
clr.AddReference('RevitAPIUI')
from Autodesk.Revit.DB import *

clr.AddReference('RevitServices')
import RevitServices
from RevitServices.Persistence import DocumentManager
from RevitServices.Transactions import TransactionManager

#import dynamo libaries for creating a point
clr.AddReference('ProtoGeometry')
from Autodesk.DesignScript.Geometry import Point

import clr
clr.AddReference('System')
from System import Guid, Int32

doc = DocumentManager.Instance.CurrentDBDocument
uidoc=DocumentManager.Instance.CurrentUIApplication.ActiveUIDocument


in_elements = UnwrapElement(IN[0])

elements = []

for index,p in enumerate(in_elements):
    if p.LookupParameter("Scope Box"):
        if p.LookupParameter("Scope Box").AsElementId().ToString() != "-1":
            elements.append(in_elements[index])

OUT = elements
# ----------------------------------------
save_current_location = BoolSelector(false)  # graph input
save_view_location = Python(IN[0]=grab_views_that_have_scope_boxes, IN[1]=save_current_location)  # CPython3
# ---------- save_view_location.python (28 lines) ----------
import os
from Autodesk.Revit.DB import XYZ, Transaction
from RevitServices.Persistence import DocumentManager
from RevitServices.Transactions import TransactionManager

# Get the current document from the Document Manager
doc = DocumentManager.Instance.CurrentDBDocument

# Get the list of viewpoints from the input
viewports = UnwrapElement(IN[0])
bool = IN[1]

# Define the file path based on the Revit model's location or the user's home directory
model_path = doc.PathName

if bool:
    file_path = os.path.join(os.path.dirname(model_path), "viewport_location.txt")
    
    # Open the file in write mode and write the viewpoints
    with open(file_path, 'w') as file:
        for viewport in viewports:
            viewpoint_id = viewport.Id
            point_location = viewport.GetBoxCenter()
            file.write("Viewport ID: {}, Location: ({}, {}, {})\n".format(
                viewpoint_id,
                point_location.X,
                point_location.Y,
                point_location.Z))
# ----------------------------------------
update_view = Python(IN[0]=save_current_location)  # CPython3
# ---------- update_view.python (65 lines) ----------
import re
import os
import clr

clr.AddReference('RevitServices')
import RevitServices
from RevitServices.Persistence import DocumentManager
from RevitServices.Transactions import TransactionManager

doc = DocumentManager.Instance.CurrentDBDocument
uidoc=DocumentManager.Instance.CurrentUIApplication.ActiveUIDocument


from Autodesk.Revit.DB import XYZ, Transaction, Viewport
from Autodesk.Revit.DB import ElementId as RevitElementId

bool = IN[0]
OUT = []
if not bool:

    # Define the file path based on the Revit model's location or the user's home directory
    model_path = doc.PathName
    file_path = os.path.join(os.path.dirname(model_path), "viewport_location.txt")

# Open the file in read mode
    with open(file_path, 'r') as file:
        # Read all lines from the file
        lines = file.readlines()
    
    
    
        # Loop through the lines
        for line in lines:
            # Parse the viewpoint ID and location from the line
            parts = line.split(", ")
            viewport_id = int(parts[0].split(": ")[1])
            location_parts = parts[1].split(": ")[1].strip("()\n").split(", ")
            location_parts = re.findall(r"[-+]?\d*\.\d+|\d+", line)
            location_parts = location_parts[1:4]
            location = XYZ(float(location_parts[0]), float(location_parts[1]), float(location_parts[2]))
            
            TransactionManager.Instance.EnsureInTransaction(doc)

			
            # Get the viewpoint element
            viewport = doc.GetElement(RevitElementId(viewport_id))
    
            # Get the sheet and view from the viewpoint
            sheet = doc.GetElement(viewport.SheetId)
            view = doc.GetElement(viewport.ViewId)
    
            # Delete the old viewpoint
            doc.Delete(viewport.Id)
    
            # Create a new viewport at the same location
            new_viewport = Viewport.Create(doc, sheet.Id, view.Id, location)
    
            # Add the new viewport to the output
            OUT.append(new_viewport)
            TransactionManager.Instance.TransactionTaskDone()



  
  
# ----------------------------------------
