# Dynamo graph scopebox - 2024.dyn (Dynamo 2.19.3.6394)
# packages: spring nodes 210.1.1, bimorphNodes 4.2.1

code_block = CodeBlock { "RVT Links"; }
byName = Category.ByName(name=code_block)
all_elements_of_category = ElementsOfCategory(Category=byName)
code_block_2 = CodeBlock { "File Name"; }
get_type_parameter = Python(IN[0]=all_elements_of_category, IN[1]=code_block_2)  # CPython3
# ---------- get_type_parameter.python (50 lines) ----------
import clr

# Add references to the required Revit API libraries
clr.AddReference('RevitAPI')
clr.AddReference('RevitServices')

# Import specific classes from Revit API and services
from Autodesk.Revit.DB import ElementId, Parameter, BuiltInParameter
from RevitServices.Persistence import DocumentManager

# Set the active document in Revit
doc = DocumentManager.Instance.CurrentDBDocument

# Helper function to unwrap elements from Dynamo to Revit API objects
def unwrap_elements(input):
    return [UnwrapElement(i) for i in input] if isinstance(input, list) else [UnwrapElement(input)]

# Retrieves the element type of a given element
def get_element_type(element):
    return doc.GetElement(element.GetTypeId())

# Retrieves the value of a parameter by name from an element type
def get_parameter_value(element_type, param_name):
    param = element_type.LookupParameter(param_name)
    return param.AsString() if param else None

# Main process
try:
    # Unwrap the input elements
    elements = unwrap_elements(IN[0])
    # Retrieve element types
    element_types = [get_element_type(e) for e in elements if e.GetTypeId()]
    # Output variable
    output = []

    # If multiple parameter names are provided, handle them
    if isinstance(IN[1], list):
        param_names = IN[1]
        for param_name in param_names:
            output.append([get_parameter_value(et, param_name) for et in element_types])
        # Transpose the list to match elements to parameter values
        OUT = list(map(list, zip(*output)))
    else:
        # If only one parameter name is provided
        param_name = IN[1]
        OUT = [get_parameter_value(et, param_name) for et in element_types]

except Exception as e:
    # If an error occurs, catch it and assign the traceback to the output
    OUT = str(e)
# ----------------------------------------
code_block_3 = CodeBlock { "Scope Boxes"; }
eq = get_type_parameter == code_block_3
filterByBoolMask = List.FilterByBoolMask(list=all_elements_of_category, mask=eq)
code_block_4 = CodeBlock { "Scope Boxes"; }
byName_2 = Category.ByName(name=code_block_4)
# note: bimorphNodes
ofCategory = Revit.LinkElement.OfCategory(linkInstance=filterByBoolMask.in, category=byName_2)
flatten = List.Flatten(list=ofCategory)
geometry = Element.Geometry(element=flatten)
byGeometry = BoundingBox.ByGeometry(geom=geometry)
code_block_5 = CodeBlock { "Floors"; }
byName_3 = Category.ByName(name=code_block_5)
all_elements_of_category_2 = ElementsOfCategory(Category=byName_3)
geometry_2 = Element.Geometry(element=all_elements_of_category_2)
flatten_2 = List.Flatten(list=geometry_2)
byGeometry_2 = BoundingBox.ByGeometry(geom=flatten_2)
integer_slider = IntegerSlider(4, range=1..12 step 1)
python_script = Python(IN[0]=byGeometry, IN[1]=byGeometry_2, IN[2]=integer_slider)  # CPython3
# ---------- python_script.python (60 lines) ----------
"""
This script includes logic for selecting a scope box based on its ability to encompass a given floor plan. 
The selection process accounts for a specified 'fit_rank', choosing an appropriate scope box that best matches the size criteria. 
If the 'fit_rank' exceeds the available suitable scope boxes, it iteratively adjusts to find the largest fitting scope box.
Portions of this script were conceptualized with the assistance of ChatGPT, an AI language model by OpenAI.
"""



# Import necessary libraries
import clr

# Adding Reference to RevitAPI
clr.AddReference('RevitAPI')
from Autodesk.Revit.DB import BoundingBoxXYZ

# Define inputs from Dynamo
scope_boxes = IN[0]  # List of Dynamo BoundingBox objects for scope boxes
floor_plan_box = IN[1]  # Dynamo BoundingBox object for the floor plan
fit_rank = IN[2]  # The desired rank for the fit (1 for best fit, 2 for second-best, etc.)

# Function to compare sizes of bounding boxes regardless of position
def can_encompass(scope_box, floor_plan):
    scope_box_width = scope_box.MaxPoint.X - scope_box.MinPoint.X
    scope_box_depth = scope_box.MaxPoint.Y - scope_box.MinPoint.Y
    floor_plan_width = floor_plan.MaxPoint.X - floor_plan.MinPoint.X
    floor_plan_depth = floor_plan.MaxPoint.Y - floor_plan.MinPoint.Y
    return scope_box_width >= floor_plan_width and scope_box_depth >= floor_plan_depth

# Function to calculate the area of a bounding box in XY plane
def bounding_box_area(box):
    width = box.MaxPoint.X - box.MinPoint.X
    depth = box.MaxPoint.Y - box.MinPoint.Y
    return width * depth

# Find all scope boxes that are larger than the floor plan and store their area differences
fits = [(bounding_box_area(scope_box) - bounding_box_area(floor_plan_box), i)
        for i, scope_box in enumerate(scope_boxes) if can_encompass(scope_box, floor_plan_box)]

# Sort the list by area difference in ascending order
fits.sort()

# If there are no scope boxes that can encompass the floor plan, default to the largest scope box
if not fits:
    # Find the largest scope box by area
    largest_scope_box_index = max(enumerate(scope_boxes), key=lambda x: bounding_box_area(x[1]))[0]
    filter_list = [i == largest_scope_box_index for i in range(len(scope_boxes))]
else:
    # Adjust fit_rank if it's higher than the number of fits available
    while fit_rank > len(fits) and fit_rank > 1:
        fit_rank -= 1

    # Get the index of the desired fit
    desired_fit_index = fits[fit_rank - 1][1]

    # Generate the filter list based on the desired fit index
    filter_list = [i == desired_fit_index for i in range(len(scope_boxes))]

# Output the filter list
OUT = filter_list
# ----------------------------------------
filterByBoolMask_2 = List.FilterByBoolMask(list=flatten, mask=python_script)
copyToActiveDocument = Revit.LinkElement.CopyToActiveDocument(linkElements=filterByBoolMask_2.in)
geometry_3 = Element.Geometry(element=copyToActiveDocument)
flatten_3 = List.Flatten(list=geometry_3)
byGeometry_3 = BoundingBox.ByGeometry(geom=flatten_3)
ꟿ_boundingbox_midpoint = Custom[ꟿ BoundingBox.MidPoint](boundingBox=byGeometry_3)  # package spring nodes; Fetches the mid point of the bounding box.
X = Point.X(point=ꟿ_boundingbox_midpoint)
Y = Point.Y(point=ꟿ_boundingbox_midpoint)
byCoordinates = Point.ByCoordinates(x=X, y=Y)
# note: spring nodes
ꟿ_boundingbox_midpoint_2 = Custom[ꟿ BoundingBox.MidPoint](boundingBox=byGeometry_2)
X_2 = Point.X(point=ꟿ_boundingbox_midpoint_2)
Y_2 = Point.Y(point=ꟿ_boundingbox_midpoint_2)
byCoordinates_2 = Point.ByCoordinates(x=X_2, y=Y_2)
byTwoPoints = Vector.ByTwoPoints(start=byCoordinates, end=byCoordinates_2)
moveByVector = Element.MoveByVector(element=copyToActiveDocument, vector=byTwoPoints)
