# Dynamo graph CAD Doors.dyn (Dynamo 2.10.1.3976)
# packages: bimorphNodes 3.0.3, archi-lab.net 2021.25.18

reportInstances = CAD.ReportInstances()
code_block = CodeBlock { 0; }
getItemAtIndex = List.GetItemAtIndex(list=reportInstances.CADLinks, index=code_block)
watch = Watch(getItemAtIndex)
code_block_2 = CodeBlock { "E-F-DOOR"; }

# group: Update Door Layer name
curvesFromCADLayers = CAD.CurvesFromCADLayers(importInstance=watch, layerNames=code_block_2)

watch_2 = Watch(curvesFromCADLayers.Curve)
flatten = List.Flatten(list=watch_2)
group_curves = Custom[Group Curves](curves=flatten)  # package archi-lab.net
type = Object.Type(obj=group_curves)
code_block_3 = CodeBlock(x=type) { x == "Autodesk.DesignScript.Geometry.Arc"; }
filterByBoolMask = List.FilterByBoolMask(list=group_curves, mask=code_block_3)
watch_3 = Watch(filterByBoolMask.out)
length = Curve.Length(curve=watch_3)
maximumItem = List.MaximumItem(list=length)
eq = length@L2 == maximumItem@L1
filterByBoolMask_2 = List.FilterByBoolMask(list=watch_3, mask=eq)
startPoint = Curve.StartPoint(curve=filterByBoolMask_2.out)
code_block_4 = CodeBlock { 0.1; }
pruneDuplicates = Point.PruneDuplicates(points=startPoint, tolerance=code_block_4)
count = List.Count(list=pruneDuplicates@L2)
code_block_5 = CodeBlock { 4; }
gt = count > code_block_5
filterByBoolMask_3 = List.FilterByBoolMask(list=pruneDuplicates, mask=gt)
watch_4 = Watch(filterByBoolMask_3.in)
python_script = Python(IN[0]=watch_4)  # IronPython2
# ---------- python_script.python (32 lines) ----------
# Load the Python Standard and DesignScript Libraries
import sys
import clr
clr.AddReference('ProtoGeometry')
from Autodesk.DesignScript.Geometry import *
from Autodesk.DesignScript.Geometry import UV

data = UnwrapElement(IN[0])

distances = []
for points in data:
	distances_sub_l3_list = []
	for p0 in points:
		distances_sub_l2_list = []
		for p1 in points:
			distances_sub_l2_list.append(p0.DistanceTo(p1))
		distances_sub_l3_list.append(distances_sub_l2_list)
	distances.append(distances_sub_l3_list)

sums = []
for l in distances:
	sub_list_sums = []
	for l3 in l:
		sub_list_sums.append(sum(l3))
	sums.append(sub_list_sums)	

indexes = []
for l in sums:
	indexes.append(l.index(max(l)))


OUT = indexes
# ----------------------------------------
python_script_2 = Python(IN[0]=watch_4, IN[1]=python_script)  # IronPython2
# ---------- python_script_2.python (6 lines) ----------
list_of_points = IN[0]
indexes = IN[1]
OUT = []
for l, i in zip(list_of_points, indexes):
	del l[i]
	OUT.append(l)
# ----------------------------------------
Y = Point.Y(point=python_script_2)
minimumItem = List.MinimumItem(list=Y)
maximumItem_2 = List.MaximumItem(list=Y)
sub = minimumItem - maximumItem_2
abs = Math.Abs(number=sub)
X = Point.X(point=python_script_2)
minimumItem_2 = List.MinimumItem(list=X)
maximumItem_3 = List.MaximumItem(list=X)
sub_2 = minimumItem_2 - maximumItem_3
abs_2 = Math.Abs(number=sub_2)
gt_2 = abs > abs_2
filterByBoolMask_4 = List.FilterByBoolMask(list=python_script_2, mask=gt_2)
Y_2 = Point.Y(point=filterByBoolMask_4.in)
max_index = Python(IN[0]=Y_2)  # IronPython2
# ---------- max_index.python (6 lines) ----------
data = IN[0]

l = []
for i in data:
	l.append(i.index(max(i)))
OUT = l
# ----------------------------------------
getItemAtIndex_2 = List.GetItemAtIndex(list=filterByBoolMask_4.in@L2, index=max_index@L1)
X_2 = Point.X(point=getItemAtIndex_2)
min_index = Python(IN[0]=Y_2)  # IronPython2
# ---------- min_index.python (6 lines) ----------
data = IN[0]

l = []
for i in data:
	l.append(i.index(min(i)))
OUT = l
# ----------------------------------------
getItemAtIndex_3 = List.GetItemAtIndex(list=filterByBoolMask_4.in@L2, index=min_index@L1)
Y_3 = Point.Y(point=getItemAtIndex_3)
Z = Point.Z(point=getItemAtIndex_2)
byCoordinates = Point.ByCoordinates(x=X_2, y=Y_3, z=Z)
byStartPointEndPoint = Line.ByStartPointEndPoint(startPoint=getItemAtIndex_2, endPoint=byCoordinates)
X_3 = Point.X(point=filterByBoolMask_4.out)
max_index_2 = Python(IN[0]=X_3)  # IronPython2; same code as max_index
getItemAtIndex_4 = List.GetItemAtIndex(list=filterByBoolMask_4.out@L2, index=max_index_2@L1)
min_index_2 = Python(IN[0]=X_3)  # IronPython2; same code as min_index
getItemAtIndex_5 = List.GetItemAtIndex(list=filterByBoolMask_4.out@L2, index=min_index_2@L1)
X_4 = Point.X(point=getItemAtIndex_5)
Y_4 = Point.Y(point=getItemAtIndex_4)
Z_2 = Point.Z(point=getItemAtIndex_4)
byCoordinates_2 = Point.ByCoordinates(x=X_4, y=Y_4, z=Z_2)
byStartPointEndPoint_2 = Line.ByStartPointEndPoint(startPoint=getItemAtIndex_4, endPoint=byCoordinates_2)
code_block_6 = CodeBlock { "Doors"; }
