# Dynamo graph Check overlapping Viewports.dyn (Dynamo 2.13.1.3887)

code_block = CodeBlock { "Sheets"; }
byName = Category.ByName(name=code_block)
all_elements_of_category = ElementsOfCategory(Category=byName)
viewports = Sheet.Viewports(sheet=all_elements_of_category)
boxOutline = Viewport.BoxOutline(viewport=viewports)
original_script = Python(IN[0]=boxOutline)  # CPython3; frozen
# ---------- original_script.python (36 lines) ----------
# The BIM Coordinators Dynamo Python Template
# Subscribe: https://www.youtube.com/c/TheBIMCoordinator/featured
# Follow me on LinkedIn: https://www.linkedin.com/in/dalton-goodwin-067a07107/

"""
Dynamo Core Assemblies: 
https://www.nuget.org/packages/DynamoVisualProgramming.Core/2.13.1.3887

Revit API: 
https://www.revitapidocs.com/2020/d4648875-d41a-783b-d5f4-638df39ee413.htm
"""

"""
C:\Program Files\Autodesk\Revit 2022\AddIns\DynamoForRevit

C:\Program Files\Autodesk\Revit 2022\AddIns\DynamoForRevit\Revit

"""

import clr

clr.AddReference('ProtoGeometry')
from Autodesk.DesignScript.Geometry import BoundingBox

OUT = []
viewport_bounding_boxes = UnwrapElement(IN[0])
for boxes in viewport_bounding_boxes:
    bools = []
    if len(boxes) > 1:
        for i, box in enumerate(boxes):
            for j, other_box in enumerate(boxes):
                if i != j and BoundingBox.Intersects(box, other_box):
                    bools.append(True)
                else: bools.append(False)
        OUT.append(any(bools))
    else: OUT.append(False)
# ----------------------------------------
refactored_by_chatgpt = Python(IN[0]=boxOutline)  # CPython3
# ---------- refactored_by_chatgpt.python (46 lines) ----------
# The BIM Coordinators Dynamo Python Template
# Subscribe: https://www.youtube.com/c/TheBIMCoordinator/featured
# Follow me on LinkedIn: https://www.linkedin.com/in/dalton-goodwin-067a07107/

"""
Dynamo Core Assemblies: 
https://www.nuget.org/packages/DynamoVisualProgramming.Core/2.13.1.3887

Revit API: 
https://www.revitapidocs.com/2020/d4648875-d41a-783b-d5f4-638df39ee413.htm
"""

"""
C:\Program Files\Autodesk\Revit 2022\AddIns\DynamoForRevit

C:\Program Files\Autodesk\Revit 2022\AddIns\DynamoForRevit\Revit

"""

import clr

clr.AddReference('ProtoGeometry')
from Autodesk.DesignScript.Geometry import BoundingBox

#pop items from list
#stop loop when true


OUT = []
viewport_bounding_boxes = IN[0]

for boxes in viewport_bounding_boxes:
    if len(boxes) > 1:
        for i, box in enumerate(boxes):
            intersects = False
            for j, other_box in enumerate(boxes):
                if i != j and BoundingBox.Intersects(box, other_box):
                    intersects = True
                    break
            if intersects:
                break
            else:
                boxes.pop(i)
        OUT.append(intersects)   
    else:
        OUT.append(False)
# ----------------------------------------
refactored_by_chatgpt_and = Python(IN[0]=boxOutline)  # "Refactored by ChatGPT and further developed"; CPython3
# ---------- refactored_by_chatgpt_and.python (84 lines) ----------
# The BIM Coordinators Dynamo Python Template
# Subscribe: https://www.youtube.com/c/TheBIMCoordinator/featured
# Follow me on LinkedIn: https://www.linkedin.com/in/dalton-goodwin-067a07107/

"""
Dynamo Core Assemblies: 
https://www.nuget.org/packages/DynamoVisualProgramming.Core/2.13.1.3887

Revit API: 
https://www.revitapidocs.com/2020/d4648875-d41a-783b-d5f4-638df39ee413.htm
"""

"""
C:\Program Files\Autodesk\Revit 2022\AddIns\DynamoForRevit

C:\Program Files\Autodesk\Revit 2022\AddIns\DynamoForRevit\Revit

"""

import clr
import math

clr.AddReference('ProtoGeometry')
from Autodesk.DesignScript.Geometry import BoundingBox, Point


bools = []
intersection_area_per = []
OUT = [bools, intersection_area_per]
viewport_bounding_boxes = IN[0]

def distance(point1, point2):
    x1, y1 = point1
    x2, y2 = point2
    return math.sqrt((x2 - x1)**2 + (y2 - y1)**2)
  
def get_boundingbox_area(boundingbox):
    #for efficiency we will not create a point but rather calc the nums
    
    new_point = (boundingbox.MaxPoint.X, boundingbox.MinPoint.Y)
    
    max_point = (boundingbox.MaxPoint.X, boundingbox.MaxPoint.Y)
    
    min_point = (boundingbox.MinPoint.X, boundingbox.MinPoint.Y)
    
    area = distance(new_point, max_point) * distance(new_point, min_point)
    
    return area

for boxes in viewport_bounding_boxes:
    if len(boxes) > 1:
        for i, box in enumerate(boxes):
            intersects = False
            for j, other_box in enumerate(boxes):
                if i != j and BoundingBox.Intersects(box, other_box):
                    intersects = True
                  
                    #get overlap %
                    boundingbox_overlap = BoundingBox.Intersection(box, other_box)
                    
                    total_overlap_area = get_boundingbox_area(boundingbox_overlap)
                    
                    min_boundingbox = box
                    
                    if get_boundingbox_area(box) > get_boundingbox_area(other_box):
                        min_boundingbox = other_box
                  
                    min_boundingbox_area = get_boundingbox_area(min_boundingbox)
                    
                    areas = [min_boundingbox_area, total_overlap_area]
                    
                    intersection_area_per.append((min(areas) / max(areas)) * 100)
                  
                    #stop loop when true
                    break
            if intersects:
                #stop loop when true
                break
            else:
                #pop item from list. Optimization purposes
                boxes.pop(i)
        bools.append(intersects)   
    else:
        bools.append(False)
# ----------------------------------------
code_block_2 = CodeBlock(x=refactored_by_chatgpt_and) { x[0]; x[1]; }
filterByBoolMask = List.FilterByBoolMask(list=all_elements_of_category, mask=code_block_2.out0)
code_block_3 = CodeBlock { "Sheet Number"; }
getParameterValueByName = Element.GetParameterValueByName(element=filterByBoolMask.in, parameterName=code_block_3)
watch = Watch(code_block_2.out1)
code_block_4 = CodeBlock { 96; }
gt = watch > code_block_4
filterByBoolMask_2 = List.FilterByBoolMask(list=getParameterValueByName, mask=gt)
