# Dynamo graph Dynamo - Copy Elements from Link.dyn (Dynamo 2.12.0.5650)
# packages: Orchid 230.0.3.7536, bimorphNodes 4.1.2, archi-lab.net 2022.212.2722

getDocuments = archilab.Revit.Selection.Select.GetDocuments()
code_block = CodeBlock { "Mechanical Equipment"; }
byName = Category.ByName(name=code_block)
ofCategory = Revit.LinkElement.OfCategory(linkInstance=getDocuments.Link_Instance, category=byName)
flatten = List.Flatten(list=ofCategory)
name = Element.Name(element=flatten)
uniqueItems = List.UniqueItems(list=name)
code_block_2 = CodeBlock(x=uniqueItems) { x[1]; }
eq = name == code_block_2
filterByBoolMask = List.FilterByBoolMask(list=flatten, mask=eq)
copyElement = Orchid.RevitProject.Common.Link.CopyElement(instance=getDocuments.Link_Instance, element=filterByBoolMask.in)
