# Dynamo graph ExampleScript.dyn (Dynamo 2.13.1.3887)

code_block = CodeBlock { ["Elec", "bath", "Library", "Bar"]; }
python_script = Python(IN[0]=code_block)  # CPython3
# ---------- python_script.python (78 lines) ----------
#The BIM Coordinators Dynamo Python Template
#Subscribe to my YouTube: https://www.youtube.com/c/TheBIMCoordinator/featured
#Follow my on LinkedIn: https://www.linkedin.com/in/dalton-goodwin-067a07107/

"""
Dynamo Core Assemblies: 
https://www.nuget.org/packages/DynamoVisualProgramming.Core/2.13.1.3887

Revit API: 
https://www.revitapidocs.com/2020/d4648875-d41a-783b-d5f4-638df39ee413.htm
"""

"""
C:\Program Files\Autodesk\Revit 2022\AddIns\DynamoForRevit

C:\Program Files\Autodesk\Revit 2022\AddIns\DynamoForRevit\Revit

"""


import sys
sys.path.append(r"C:\Users\dalto\OneDrive\Desktop\Company Python Lib")

from Levenshtein import distance as lev
from fuzzywuzzy import fuzz
from fuzzywuzzy import process

room_name_groups = [["Office", "Admin"],
["Toilet", "Men", "Women", "Restroom", "Bath", "Shower", "Bathroom"],
["Janitor", "Jan", "workroom", "Copy", "Pantry", "Supply"],
["Gymnasium", "Gym"],
["Lounge", "Breakroom","Coffee"],
["Conference", "Meeting", "Breakout", "Collaboration", "Group"],
["Lobby", "Entry", "Foyer", "Front Desk", "Reception", "Check-in"],
["Classroom", "Multi-Purpose", "Grade", "Training", "Lecture","Instruction"],
["Corridor", "Hallway", "Circulation"],
["Open Office", "Cube Farm"],
["Storage", "Closet"],
["Laundry", "Wash", "Dry"],
["Library", "Stacks", "Reading", "Book"],
["Stairs", "Stairway"],
["Workshop", "Maintenance", "Repair", "Shop"],
["Mech", "Elec", "IDF", "Data", "Server", "Telecom", "MDF"],
["Bedroom", "BR", "Bed", "Suite", "Dorm"],
["Cell", "Confinement"],
["Art", "Science", "Wet", "Lab"],
["Lunchroom", "Activity", "Cafeteria", "Banquet"],
["Exam", "Treatment", "Chiro"],
["Locker", "Mens Locker", "Womens Locker", "Locker Room"],
["Dining", "Bar", "Cafe"],
["Kitchen", "Food Prep", "Cook"],
["Elevator", "Elev Lobby", "Area of Refuge"],
["Auditorium"],
["Theater", "Movie", "Cinema"],
["Fitness", "Workout", "Dance", "Weight"],
["Courtroom"],
["Dressing", "Dressing Room", "Changing"]]


room_names = IN[0]

def space_groups(room_name):
    room_name_group_vals = []
    for room_names in room_name_groups:
        room_names_OUT = []
        for room in room_names:
            room_names_OUT.append(fuzz.ratio(room_name,room))
        room_name_group_vals.append(room_names_OUT)
    max_val = 0
    for index, val_group in enumerate(room_name_group_vals):
        if max(val_group) > max_val:
            max_val = max(val_group)
            room_name_group = room_name_groups[index]
    return room_name_group

OUT = []
for room_name in room_names:
    OUT.append(space_groups(room_name))
# ----------------------------------------
