# Dynamo graph FuzzyWuzzy.dyn (Dynamo 2.12.0.5650)

python_script = Python()  # CPython3; unwired: IN[0]
# ---------- python_script.python (96 lines) ----------
"""
Dynamo Core Assemblies: 
https://www.nuget.org/packages/DynamoVisualProgramming.Core/2.13.1.3887
Revit API: 
https://www.revitapidocs.com/2020/d4648875-d41a-783b-d5f4-638df39ee413.htm
"""

"""
C:\Program Files\Autodesk\Revit 2022\AddIns\DynamoForRevit
C:\Program Files\Autodesk\Revit 2022\AddIns\DynamoForRevit\Revit
"""


import sys
sys.path.append(r"N:\Revit\Common\Dynamo\Support\Packages\HEI Python venv")


import clr

clr.AddReference('ProtoGeometry')
from Autodesk.DesignScript.Geometry import Vector, Line

clr.AddReference('RevitAPI')
from Autodesk.Revit.DB import *
from Autodesk.Revit.DB.Structure import *

clr.AddReference('RevitAPIUI')
from Autodesk.Revit.UI import *

clr.AddReference('System')
from System.Collections.Generic import List

clr.AddReference('RevitNodes')
import Revit
clr.ImportExtensions(Revit.GeometryConversion)
clr.ImportExtensions(Revit.Elements)

clr.AddReference('RevitServices')
import RevitServices
from RevitServices.Persistence import DocumentManager
from RevitServices.Transactions import TransactionManager

doc = DocumentManager.Instance.CurrentDBDocument
uidoc=DocumentManager.Instance.CurrentUIApplication.ActiveUIDocument

#Preparing input from dynamo to revit
element = UnwrapElement(IN[0])

from Levenshtein import distance as lev
from fuzzywuzzy import fuzz
from fuzzywuzzy import process

room_name_groups = [["Office", "Admin"],
["Toilet", "Men", "Women", "Restroom", "Bath", "Shower", "Bathroom"],
["Janitor", "Jan", "workroom", "Copy", "Pantry", "Supply"],
["Gymnasium", "Gym"],
["Lounge", "Breakroom","Coffee"],
["Conference", "Meeting", "Breakout", "Collaboration", "Group"],
["Lobby", "Entry", "Foyer", "Front Desk", "Reception", "Check-in"],
["Classroom", "Multi-Purpose", "Grade", "Training", "Lecture","Instruction"],
["Corridor", "Hallway", "Circulation"],
["Open Office", "Cube Farm"],
["Storage", "Closet"],
["Laundry", "Wash", "Dry"],
["Library", "Stacks", "Reading", "Book"],
["Stairs", "Stairway"],
["Workshop", "Maintenance", "Repair", "Shop"],
["Mech", "Elec", "IDF", "Data", "Server", "Telecom", "MDF"],
["Bedroom", "BR", "Bed", "Suite", "Dorm"],
["Cell", "Confinement"],
["Art", "Science", "Wet", "Lab"],
["Lunchroom", "Activity", "Cafeteria", "Banquet"],
["Exam", "Treatment", "Chiro"],
["Locker", "Mens Locker", "Womens Locker", "Locker Room"],
["Dining", "Bar", "Cafe"],
["Kitchen", "Food Prep", "Cook"],
["Elevator", "Elev Lobby", "Area of Refuge"],
["Auditorium"],
["Theater", "Movie", "Cinema"],
["Fitness", "Workout", "Dance", "Weight"],
["Courtroom"],
["Dressing", "Dressing Room", "Changing"]]


room_name_group_vals = []
for room_names in room_name_groups:
    room_names_OUT = []
    for room in room_names:
        room_names_OUT.append(fuzz.ratio("Electrical",room))
    room_name_group_vals.append(room_names_OUT)
max_val = 0
for index, val_group in enumerate(room_name_group_vals):
    if max(val_group) > max_val:
        max_val = max(val_group)
        OUT = room_name_groups[index]
    
# ----------------------------------------
