# Dynamo graph CAD to Revit 2020.dyn (Dynamo 2.12.0.5650)
# packages: bimorphNodes 4.0.13, bimorphNodes 4.1.2

levels = Levels("MEP-Level 1")
reportInstances = Revit.ImportInstance.ReportInstances()
importInstance = Revit.ImportInstanceReport.ImportInstance(importInstanceReport=reportInstances)
code_block = CodeBlock(X=importInstance) { X[1]; }
code_block_2 = CodeBlock { "X-AREA-IDEN"; }
fromLayers = CADTextData.FromLayers(importInstance=code_block, layerNames=code_block_2)

# group: Get text from CAD ImportInstance
code_block_3 = CodeBlock { "EMPLOYEE"; }
flatten = List.Flatten(list=fromLayers.CADTextData)

originPoint = CADTextData.OriginPoint(cADTextData=flatten)
textValue = CADTextData.TextValue(cADTextData=flatten)
python_script = Python(IN[0]=originPoint, IN[1]=textValue)  # IronPython2
# ---------- python_script.python (36 lines) ----------
# Load the Python Standard and DesignScript Libraries
import sys
import clr
clr.AddReference('ProtoGeometry')
from Autodesk.DesignScript.Geometry import *

points = IN[0] #list of points
text = IN[1]
point_groups = []
text_groups = []

while len(points) > 0:
    p = points.pop()
    point_group = [p]
    
    t = text.pop()
    text_group = [t]
    
    temp_index = [] #indexes to remove from points after looping
    for index, p2, t2 in zip(range(len(points)),points, text):
        if p2.DistanceTo(p) < 3:
            point_group.append(p2)
            text_group.append(t2)
            temp_index.append(index)
    point_groups.append(point_group)
    text_groups.append(text_group)
    
    x = 0
    for i in temp_index:
    	points.pop(i+x)
    	text.pop(i+x)
    	x += -1
	

    
OUT = point_groups, text_groups
# ----------------------------------------
code_block_4 = CodeBlock(x=python_script) { x[0]; }
code_block_5 = CodeBlock { 0; }
getItemAtIndex = List.GetItemAtIndex(list=code_block_4@L2, index=code_block_5)
code_block_6 = CodeBlock(x=python_script) { x[1]; }
code_block_7 = CodeBlock { 0; }
getItemAtIndex_2 = List.GetItemAtIndex(list=code_block_6@L2, index=code_block_7)
code_block_8 = CodeBlock { 1; }
getItemAtIndex_3 = List.GetItemAtIndex(list=code_block_6@L2, index=code_block_8)
byLocation = Room.ByLocation(level=levels, location=getItemAtIndex, name=getItemAtIndex_2, number=getItemAtIndex_3)  # frozen
