# Dynamo graph selection_length_2.dyn (Dynamo 2.17.0.3472)

# group: Start Input
start = DSModelElementSelection()  # 1 picked in the model; graph input

# group: End Input
end = DSModelElementSelection()  # 1 picked in the model; graph input

r_v2 = Python(IN[0]=start, IN[1]=end)  # CPython3
# ---------- r_v2.python (45 lines) ----------
#Preparing input from dynamo to revit
start = UnwrapElement(IN[0])
end = UnwrapElement(IN[1])
  
    
def get_connected_elements(element):
    try:
        connectors = element.ConnectorManager.Connectors
    except:
        connectors = element.MEPModel.ConnectorManager.Connectors

    connected_elements = []
    for connector in connectors:
        for connected_connector in connector.AllRefs:
            connected_element = connected_connector.Owner
            if connected_element.Id != element.Id and "System" not in connected_element.Category.Name:
                connected_elements.append(connected_element)
    return connected_elements


def find_path(start_duct, end_duct, visited=None, path=None):
    if visited is None:
        visited = set()
    if path is None:
        path = []

    visited.add(start_duct.Id)
    path.append(start_duct)

    if start_duct.Id == end_duct.Id:
        return path

    connected_elements = get_connected_elements(start_duct)
    
    for element in connected_elements:
        if element.Id not in visited:
            result = find_path(element, end_duct, visited, path)
            if result:
                return result

    path.pop()
    return None


OUT = find_path(start, end)
# ----------------------------------------
code_block = CodeBlock { "Length"; }
getParameterValueByName = Element.GetParameterValueByName(element=r_v2, parameterName=code_block)
code_block_2 = CodeBlock(len=getParameterValueByName) { len == ""; }
filterByBoolMask = List.FilterByBoolMask(list=getParameterValueByName, mask=code_block_2)
sum = Math.Sum(values=filterByBoolMask.out)
current = Document.Current()
activeView = Document.ActiveView(document=current)
isolateElementsTemporary = View.IsolateElementsTemporary(view=activeView, elements=r_v2)
