# Dynamo graph Helicone.dyn (Dynamo 2.13.0.3485)

# group: Base Cylinder
byCoordinates = Point.ByCoordinates()
code_block = CodeBlock { 3; }
byCoordinates_2 = Point.ByCoordinates(z=code_block)
number_slider = DoubleSlider(4, range=0..100 step 0.1)
byPointsRadius = Cylinder.ByPointsRadius(startPoint=byCoordinates, endPoint=byCoordinates_2, radius=number_slider)

# group: Cylinder
code_block_2 = CodeBlock { 20; }
byCoordinates_3 = Point.ByCoordinates(z=code_block_2)
number_slider_2 = DoubleSlider(0.2, range=0..100 step 0.1)
byPointsRadius_2 = Cylinder.ByPointsRadius(startPoint=byCoordinates_2, endPoint=byCoordinates_3, radius=number_slider_2)

code_block_3 = CodeBlock { [6.4, 9.6]; }
code_block_4 = CodeBlock { [[0.2, -0.2],[0.2, -0.2 ]]; }
byCoordinates_4 = Point.ByCoordinates(x=code_block_3, y=code_block_4)
python_script = Python(IN[0]=byCoordinates_4)  # CPython3
# ---------- python_script.python (17 lines) ----------
# Load the Python Standard and DesignScript Libraries
import sys
import clr
clr.AddReference('ProtoGeometry')
from Autodesk.DesignScript.Geometry import *

# The inputs to this node will be stored as a list in the IN variables.
data = IN[0]

# Place your code below this line
data[1] = data[1][::-1]

OUT = []
for l in data:
    for i in l:
        OUT.append(i)
# Assign your output to the OUT variable.
# ----------------------------------------
byCornerPoints = Rectangle.ByCornerPoints(points=python_script)
code_block_5 = CodeBlock { [10,8, 6]; }
byCoordinates_5 = Point.ByCoordinates(x=code_block_5)
number_slider_3 = DoubleSlider(0.5, range=0..100 step 0.1)
byCenterPointRadius = Circle.ByCenterPointRadius(centerPoint=byCoordinates_5, radius=number_slider_3)
join = List.Join(list0=byCornerPoints, list1=byCenterPointRadius)
byPatch = Surface.ByPatch(closedCurve=join)
byUnion = Surface.ByUnion(surfaces=byPatch)
perimeterCurves = Surface.PerimeterCurves(surface=byUnion)
code_block_6 = CodeBlock(x=byCoordinates_5) { x[1]; }
byTwoPoints = Vector.ByTwoPoints(start=code_block_6, end=byCoordinates)
translate = Geometry.Translate(geometry=perimeterCurves, direction=byTwoPoints)
offset_from_the_base = DoubleSlider(5, range=0..100 step 0.1)
code_block_7 = CodeBlock(x=code_block, offset=offset_from_the_base) { x + offset; }
plane_thickness = CodeBlock { 0.3; }
code_block_8 = CodeBlock(x=code_block_2, y=plane_thickness) { x - y; }
range = Range(start=code_block_7, end=code_block_8, step=plane_thickness)
byCoordinates_6 = Point.ByCoordinates(z=range)
byOriginNormal = Plane.ByOriginNormal(origin=byCoordinates_6)
pullOntoPlane = Curve.PullOntoPlane(curve=translate, plane=byOriginNormal, lacing=CrossProduct)
transpose = List.Transpose(lists=pullOntoPlane)
byJoinedCurves = PolyCurve.ByJoinedCurves(curves=transpose)
byPatch_2 = Surface.ByPatch(closedCurve=byJoinedCurves)
thickness = CodeBlock { 0.2; }
code_block_9 = CodeBlock { 0; }
thicken = Surface.Thicken(surface=byPatch_2, thickness=thickness, both_sides=code_block_9)
code_block_10 = CodeBlock { 1; }
byCoordinates_7 = Vector.ByCoordinates(z=code_block_10)
number_slider_4 = DoubleSlider(25.1, range=0..100 step 0.1)
rotate = Geometry.Rotate(geometry=thicken, origin=byCoordinates, axis=byCoordinates_7, degrees=number_slider_4)
