# Dynamo graph Dynamo instance vars.dyn (Dynamo 2.17.0.3472)

code_block = CodeBlock { [1, 2]; [2, 1]; }
byCoordinates = Point.ByCoordinates(x=code_block.out0, y=code_block.out1)
code_block_2 = CodeBlock { ["red", "blue"]; }
assigning_instance_vars = Python(IN[0]=byCoordinates, IN[1]=code_block_2)  # CPython3
# ---------- assigning_instance_vars.python (60 lines) ----------
#The BIM Coordinators Dynamo Python Template
#Subscribe to my YouTube: https://www.youtube.com/c/TheBIMCoordinator/featured
#Follow me on LinkedIn: https://www.linkedin.com/in/dalton-goodwin-067a07107/

"""
Dynamo Core Assemblies: 
https://www.nuget.org/packages/DynamoVisualProgramming.Core/2.13.1.3887

Revit API: 
https://www.revitapidocs.com/2020/d4648875-d41a-783b-d5f4-638df39ee413.htm
"""

"""
C:\Program Files\Autodesk\Revit 2022\AddIns\DynamoForRevit

C:\Program Files\Autodesk\Revit 2022\AddIns\DynamoForRevit\Revit

"""


import sys
sys.path.append("C:\\Users\\dalto\\anaconda3\\envs\\Dynamo_2022\\Lib")
sys.path.append("C:\\Users\\dalto\\OneDrive\\My Stuff\\GitHub\\All-Sorts-of-Dynamo-Scripts\\Python Module")

import clr

clr.AddReference('ProtoGeometry')
from Autodesk.DesignScript.Geometry import Vector, Line

clr.AddReference('RevitAPI')
from Autodesk.Revit.DB import *
from Autodesk.Revit.DB.Structure import *

clr.AddReference('RevitAPIUI')
from Autodesk.Revit.UI import *

clr.AddReference('System')
from System.Collections.Generic import List

clr.AddReference('RevitNodes')
import Revit
clr.ImportExtensions(Revit.GeometryConversion)
clr.ImportExtensions(Revit.Elements)

clr.AddReference('RevitServices')
import RevitServices
from RevitServices.Persistence import DocumentManager
from RevitServices.Transactions import TransactionManager

doc = DocumentManager.Instance.CurrentDBDocument
uidoc=DocumentManager.Instance.CurrentUIApplication.ActiveUIDocument

#Preparing input from dynamo to revit
elements = IN[0]
colors = IN[1]

OUT = []
for element, color in zip(elements, colors):
    element.color = color
    OUT.append(element.color)
# ----------------------------------------
wrapper_class = Python()  # CPython3
# ---------- wrapper_class.python (36 lines) ----------
#The BIM Coordinators Dynamo Python Template
#Subscribe to my YouTube: https://www.youtube.com/c/TheBIMCoordinator/featured
#Follow me on LinkedIn: https://www.linkedin.com/in/dalton-goodwin-067a07107/

import clr

clr.AddReference('ProtoGeometry')
from Autodesk.DesignScript.Geometry import Point

class ColoredPoint:
    def __init__(self, x, y, color):
        self.point = Point.ByCoordinates(x, y)
        self.color = color

    def coordinates(self):
        return f"({self.point.X}, {self.point.Y})"

    def colored_coordinates(self):
        return f"({self.point.X}, {self.point.Y}, color: {self.color})"

colored_point1 = ColoredPoint(2, 3, "red")
colored_point2 = ColoredPoint(4, 5, "blue")

OUT = colored_point1.coordinates(), colored_point1.colored_coordinates(), colored_point2.coordinates(), colored_point2.colored_coordinates() 



"""
class ColoredPoint(Point):
    def __init__(self, x, y, color):
        super().__init__(x, y)
        self.color = color

    def colored_coordinates(self):
        return f"({self.x}, {self.y}, color: {self.color})"
"""
# ----------------------------------------
class_vars = Python()  # CPython3; unwired: IN[0]
# ---------- class_vars.python (24 lines) ----------
class Point:
    def __init__(self, x, y, z):
        self.x = x
        self.y = y
        self.z = z
        
    def get_coordinates(self):
        return (self.x, self.y)
 






point1 = Point(1,2,3)
point2 = Point(4,5,6)

l = [point1, point2]

for i in l:
    i.coord = (0,0,0)
    
OUT = l[0].coord
# ----------------------------------------
