# Dynamo graph Filters By View Template.dyn (Dynamo 2.12.0.5650)
# packages: archi-lab.net 2022.210.2120

view_type = ViewTypesUi("View Template")
getByType = archilab.Revit.Views.Views.GetByType(viewType=view_type)
list_selector = ListSelector(List=getByType)
name = Element.Name(element=list_selector)
filters = View.Filters(view=list_selector)
id = Element.Id()  # unwired: element
sortByFunction = List.SortByFunction(list=filters@L2, sortFunction=id)
isFilterApplied = archilab.Revit.Views.Views.IsFilterApplied(view=list_selector, parameterFilter=sortByFunction)
filterByBoolMask = List.FilterByBoolMask(list=sortByFunction, mask=isFilterApplied)
filters_by_view_template = Element.Name(element=filterByBoolMask.in)
byKeysValues = DesignScript.Builtin.Dictionary.ByKeysValues(keys=name, values=filters_by_view_template)
flatten = List.Flatten(list=filters_by_view_template)
uniqueItems = List.UniqueItems(list=flatten)
element_types = ElementTypes("FilterElement")
all_elements_of_type = ElementsOfType(element_type=element_types)
name_2 = Element.Name(element=all_elements_of_type)
python_script = Python(IN[0]=filters_by_view_template, IN[1]=name_2)  # IronPython2
# ---------- python_script.python (12 lines) ----------
template_filters = IN[0]
filter_set = IN[1]


OUT = []
for filter in filter_set:
	count = 0
	for filter_list in template_filters:
		if filter in filter_list:
			count += 1
			
	OUT.append(count)
# ----------------------------------------
code_block = CodeBlock { 0; }
eq = python_script == code_block
filterByBoolMask_2 = List.FilterByBoolMask(list=name_2, mask=eq)
