# Dynamo graph Dynamo - Get Connector Point Location.dyn (Dynamo 2.12.0.5650)

select_model_elements = DSModelElementsSelection()  # 11 picked in the model
python_script = Python(IN[0]=select_model_elements)  # IronPython2
# ---------- python_script.python (58 lines) ----------
"""
Dynamo Core Assemblies: 
https://www.nuget.org/packages/DynamoVisualProgramming.Core/2.13.1.3887

Revit API: 
https://www.revitapidocs.com/2020/d4648875-d41a-783b-d5f4-638df39ee413.htm
"""

import sys
sys.path.append("C:\\Users\\dalto\\anaconda3\\envs\\Dynamo_2022\\Lib")
sys.path.append("C:\\Users\\dalto\\OneDrive\\My Stuff\\GitHub\\All-Sorts-of-Dynamo-Scripts\\Python Module")

import clr

clr.AddReference('RevitAPI')
from Autodesk.Revit.DB import *
from Autodesk.Revit.DB.Structure import *

clr.AddReference('RevitAPIUI')
from Autodesk.Revit.UI import *

clr.AddReference('System')
from System.Collections.Generic import List

clr.AddReference('RevitNodes')
import Revit
clr.ImportExtensions(Revit.GeometryConversion)
clr.ImportExtensions(Revit.Elements)

clr.AddReference('RevitServices')
import RevitServices
from RevitServices.Persistence import DocumentManager
from RevitServices.Transactions import TransactionManager

doc = DocumentManager.Instance.CurrentDBDocument
uidoc=DocumentManager.Instance.CurrentUIApplication.ActiveUIDocument

#Preparing input from dynamo to revit
elements = UnwrapElement(IN[0])

#Do some action in a Transaction

def get_connector_location(element):
	connector_points = [element]
	if element.Category.Name == "Ducts":
		for connector in element.ConnectorManager.Connectors:
			connector_points.append(connector.Origin.ToPoint())
	
	if element.Category.Name == "Duct Fittings":
		for connector in element.MEPModel.ConnectorManager.Connectors:
			connector_points.append(connector.Origin.ToPoint())
	
	return connector_points

OUT = []

for element in elements:
	OUT.append(get_connector_location(element))
# ----------------------------------------
