# Dynamo graph Dynamo - Get Sheets with Detail Lines.dyn "Dynamo - Get Detial Lines_" (Dynamo 2.12.0.5650)

python_script = Python()  # IronPython2
# ---------- python_script.python (23 lines) ----------
import clr
clr.AddReference("RevitNodes")
import Revit
clr.ImportExtensions(Revit.GeometryConversion)
from System.Collections.Generic import *
clr.AddReference('RevitAPI')
from Autodesk.Revit.DB import *
clr.AddReference('RevitServices')
import RevitServices
from RevitServices.Persistence import DocumentManager


doc = DocumentManager.Instance.CurrentDBDocument


lines = FilteredElementCollector(doc).OfCategory(BuiltInCategory.OST_Lines).ToElements()

OUT = set()
for line in lines:
	if line.CurveElementType.ToString() == "DetailCurve":
		view = doc.GetElement(line.OwnerViewId).LookupParameter("Sheet Number").AsString()
		if view != "---":
			OUT.add(view)
# ----------------------------------------

# group: Sheets with Detail Lines
code_block = CodeBlock { "Sheets with Detail Lines"; }
addItemToFront = List.AddItemToFront(item=code_block, list=python_script)

code_block_2 = CodeBlock { 1; }
chop = List.Chop(list=addItemToFront, lengths=code_block_2)
