# Dynamo graph List.Clean V2.dyn (Dynamo 2.13.1.3887)

# note: Item count isn't counting "Empty List"

code_block = CodeBlock { [[1,null,2,null,null], [null,null,3,4,null],[null,null],[null,1,null], [null,1,2,null,3,null,null,null]]; }
code_block_2 = CodeBlock { [[1,null,2,null,null,[],[]], [null,null,3,4,[]],[null,null],[null,1,null], [null,1,2,null,3,null,null,null]]; }
boolean = BoolSelector(true)
clean = List.Clean(list=code_block_2, preserveIndices=boolean)
return_nulls = Python(IN[0]=code_block_2, IN[1]=boolean)  # CPython3
# ---------- return_nulls.python (73 lines) ----------
#The BIM Coordinators Dynamo Python Template
#Subscribe to my YouTube: https://www.youtube.com/c/TheBIMCoordinator/featured
#Follow my on LinkedIn: https://www.linkedin.com/in/dalton-goodwin-067a07107/

"""
Dynamo Core Assemblies: 
https://www.nuget.org/packages/DynamoVisualProgramming.Core/2.13.1.3887

Revit API: 
https://www.revitapidocs.com/2020/d4648875-d41a-783b-d5f4-638df39ee413.htm
"""

"""
C:\Program Files\Autodesk\Revit 2022\AddIns\DynamoForRevit

C:\Program Files\Autodesk\Revit 2022\AddIns\DynamoForRevit\Revit

"""

l = IN[0]
bool = IN[1]

def is_null(lst):
    return all(el is None for el in lst)


def clean_list(input_list, preserve_indices=True):
    if not input_list:
        return input_list

    culled_list = []

    if preserve_indices:
        if is_null(input_list):
            return None

        j = len(input_list) - 1
        while j >= 0 and input_list[j] is None:
            j -= 1

        for i in range(j + 1):
            sublist = input_list[i]

            if isinstance(sublist, list):
                if is_null(sublist):
                    culled_list.append(None)
                else:
                    val = clean_list(sublist)
                    if val is not None and val:
                        culled_list.append(val)
            else:
                culled_list.append(input_list[i])

    else:
        if is_null(input_list):
            return []

        for el in input_list:
            if isinstance(el, list):
                if not is_null(el):
                    val = clean_list(el, preserve_indices=False)
                    if val:
                        culled_list.append(val)
            elif el is not None:
                culled_list.append(el)

    return culled_list





OUT = clean_list(l, bool)
# ----------------------------------------
python_list_clean = Python(IN[0]=code_block_2, IN[1]=boolean)  # CPython3
# ---------- python_list_clean.python (67 lines) ----------
#The BIM Coordinators Dynamo Python Template
#Subscribe to my YouTube: https://www.youtube.com/c/TheBIMCoordinator/featured
#Follow my on LinkedIn: https://www.linkedin.com/in/dalton-goodwin-067a07107/

"""
Dynamo Core Assemblies: 
https://www.nuget.org/packages/DynamoVisualProgramming.Core/2.13.1.3887

Revit API: 
https://www.revitapidocs.com/2020/d4648875-d41a-783b-d5f4-638df39ee413.htm
"""

"""
C:\Program Files\Autodesk\Revit 2022\AddIns\DynamoForRevit

C:\Program Files\Autodesk\Revit 2022\AddIns\DynamoForRevit\Revit

"""

l = IN[0]
bool = IN[1]

def is_null(lst):
    return all(el is None for el in lst)


def clean_list(input_list, preserve_indices=True):
    if not input_list:
        return input_list

    culled_list = []

    if preserve_indices:
        if is_null(input_list):
            return None

        j = len(input_list) - 1
        while j >= 0 and input_list[j] is None:
            j -= 1

        for i in range(j + 1):
            sublist = input_list[i]

            if isinstance(sublist, list):
                val = clean_list(sublist, preserve_indices)
                culled_list.append(val)
            else:
                culled_list.append(input_list[i])

    else:
        if is_null(input_list):
            return []

        for el in input_list:
            if isinstance(el, list):
                if not is_null(el):
                    val = clean_list(el, preserve_indices=False)
                    if val:
                        culled_list.append(val)
            elif el is not None:
                culled_list.append(el)

    return culled_list



OUT = clean_list(l, bool)
# ----------------------------------------
return_bools = Python(IN[0]=code_block_2)  # CPython3; unwired: IN[1]
# ---------- return_bools.python (73 lines) ----------
#The BIM Coordinators Dynamo Python Template
#Subscribe to my YouTube: https://www.youtube.com/c/TheBIMCoordinator/featured
#Follow my on LinkedIn: https://www.linkedin.com/in/dalton-goodwin-067a07107/

"""
Dynamo Core Assemblies: 
https://www.nuget.org/packages/DynamoVisualProgramming.Core/2.13.1.3887

Revit API: 
https://www.revitapidocs.com/2020/d4648875-d41a-783b-d5f4-638df39ee413.htm
"""

"""
C:\Program Files\Autodesk\Revit 2022\AddIns\DynamoForRevit

C:\Program Files\Autodesk\Revit 2022\AddIns\DynamoForRevit\Revit

"""

l = IN[0]
bool = IN[1]

def is_null(lst):
    return all(el is None for el in lst)


def clean_list(input_list, preserve_indices=True):
    if not input_list:
        return input_list

    culled_list = []

    if preserve_indices:
        if is_null(input_list):
            return None

        j = len(input_list) - 1
        while j >= 0 and input_list[j] is None:
            j -= 1

        for i in range(j + 1):
            sublist = input_list[i]

            if isinstance(sublist, list):
                val = clean_list(sublist, preserve_indices)
                culled_list.append(val if val is not None else True)
            else:
                culled_list.append(False if input_list[i] is not None else True)

    else:
        if is_null(input_list):
            return []

        for el in input_list:
            if isinstance(el, list):
                if not is_null(el):
                    val = clean_list(el, preserve_indices=False)
                    if val:
                        culled_list.append(val)
                else:
                    culled_list.append(True)
            elif el is not None:
                culled_list.append(False)
            else:
                culled_list.append(True)

    return culled_list





OUT = clean_list(l, bool)
# ----------------------------------------
code_block_3 = CodeBlock { 1; 2; }
if_ = RefactoredIf(test=return_bools, true=code_block_3.out0, false=code_block_3.out1)
