# Dynamo graph Merge Family Types.dyn "G_Merge Family Types" (Dynamo 2.19.3.6394)
# packages: Orchid 230.0.3.7536

families = Family()  # nothing selected; graph input
name = Family.Name(family=families)
string = StringInput("D:\OneDrive\Information_1\BIM\20_Social_Media_Content\2_YouTube_Vids\_Backlog\_NextUp\Dynamo - Merge Family Types\Temp Family")  # graph input
save = Orchid.RevitProject.Elements.Family.Save(family=families, path=string)
await_ = Orchid.Common.DataStream.Await(pass=name, waitFor=save)
python_script = Python(IN[0]=await_, IN[1]=string)  # CPython3
# ---------- python_script.python (31 lines) ----------
import os
import re

original_family_name = IN[0]
dir_path = IN[1]

def rename_file(dir_path, original_family_name):
    path = os.path.join(dir_path, original_family_name + ".rfa")
    
    # Check if the original file exists
    if not os.path.exists(path):
        return "Error: Original file does not exist at the specified path."

    # Remove the underscore and number from the filename
    modified_filename = re.sub(r'_\d+$', '', original_family_name)
    
    # Construct the new full path
    new_path = os.path.join(dir_path, modified_filename + ".rfa")
    
    # Check if a file with the new name already exists
    if os.path.exists(new_path):
        # Delete the existing file
        os.remove(new_path)
    
    # Rename the file
    os.rename(path, new_path)
    
    return new_path

# Example usage
OUT = rename_file(dir_path, original_family_name)
# ----------------------------------------
types = Family.Types(family=families)
byFamilyType = FamilyInstance.ByFamilyType(familyType=types)
code_block = CodeBlock { 0; }
clean = List.Clean(list=byFamilyType, preserveIndices=code_block)
boolean = BoolSelector(true)  # graph input
python_script_2 = Python(IN[0]=name)  # CPython3
# ---------- python_script_2.python (5 lines) ----------
import re

string = IN[0]

OUT = re.sub(r'_\d+$', '', string)
# ----------------------------------------
code_block_2 = CodeBlock { ""; }
if_ = If(test=boolean, true=python_script_2, false=code_block_2)
code_block_3 = CodeBlock(name=if_) { name; }
byName = Orchid.RevitProject.Elements.Family.ByName(name=code_block_3)
isEmpty = List.IsEmpty(list=byFamilyType@L2)
filterByBoolMask = List.FilterByBoolMask(list=types, mask=isEmpty)
name_2 = Element.Name(element=filterByBoolMask.out)
byFamilyAndName = FamilyType.ByFamilyAndName(family=byName, name=name_2)
setType = Orchid.RevitProject.Elements.FamilyInstance.SetType(familyInstance=clean@L2, familyType=byFamilyAndName@L1)
code_block_4 = CodeBlock { ""; }
getParameterValueByName = Element.GetParameterValueByName(element=byFamilyType, parameterName=code_block_4)
setParameterByName = Element.SetParameterByName(element=setType, parameterName=code_block_4, value=getParameterValueByName)
