# Dynamo graph MoveTagToCenter Part 1.dyn (Dynamo 2.12.0.5650)

byGeometry = BoundingBox.ByGeometry()  # unwired: geom
code_block = CodeBlock { 2.5; }

# group: BoundingBox Center
minPoint = BoundingBox.MinPoint(boundingBox=byGeometry)
maxPoint = BoundingBox.MaxPoint(boundingBox=byGeometry)
code_block_2 = CodeBlock { 5; }
byCoordinates = Vector.ByCoordinates(z=code_block_2)
translate = Geometry.Translate(geometry=maxPoint, direction=byCoordinates)
byCorners = BoundingBox.ByCorners(min=minPoint, max=translate)
toCuboid = BoundingBox.ToCuboid(boundingBox=byCorners)
centroid = Solid.Centroid(solid=toCuboid)
code_block_3 = CodeBlock(x=code_block) { -x; }
byCoordinates_2 = Vector.ByCoordinates(z=code_block_3)
translate_2 = Geometry.Translate(geometry=centroid, direction=byCoordinates_2)

code_block_4 = CodeBlock { "Rooms"; }
byName = Category.ByName(name=code_block_4)
all_elements_of_category = ElementsOfCategory(Category=byName)
centerBoundary = Room.CenterBoundary(room=all_elements_of_category)
byJoinedCurves = PolyCurve.ByJoinedCurves(curves=centerBoundary)
byPatch = Surface.ByPatch(closedCurve=byJoinedCurves)
code_block_5 = CodeBlock { 5; }
code_block_6 = CodeBlock { 0; }
thicken = Surface.Thicken(surface=byPatch, thickness=code_block_5, both_sides=code_block_6)
centroid_2 = Solid.Centroid(solid=thicken)
code_block_7 = CodeBlock(x=code_block_5) { -x/2; }
byCoordinates_3 = Vector.ByCoordinates(z=code_block_7)
translate_3 = Geometry.Translate(geometry=centroid_2, direction=byCoordinates_3)
byLocation = Room.ByLocation()  # unwired: level, location
