# Dynamo graph MoveTagToCenter Part 2.dyn "MoveTagToCenter Part 2_ latest" (Dynamo 2.12.0.5650)

code_block = CodeBlock { 0; }
code_block_2 = CodeBlock { 5; }
rooms_by_status = RoomsByStatus()
coreBoundary = Room.CoreBoundary(room=rooms_by_status.PlacedRooms)
byGeometry = BoundingBox.ByGeometry(geom=coreBoundary)
flatten = List.Flatten(list=byGeometry)
minPoint = BoundingBox.MinPoint(boundingBox=flatten)
maxPoint = BoundingBox.MaxPoint(boundingBox=flatten)
byStartPointEndPoint = Line.ByStartPointEndPoint(startPoint=minPoint, endPoint=maxPoint)
startPoint = Curve.StartPoint(curve=byStartPointEndPoint)
endPoint = Curve.EndPoint(curve=byStartPointEndPoint)
X = Point.X(point=endPoint)
X_2 = Point.X(point=startPoint)
code_block_3 = CodeBlock(x0=X, x1=X_2) { x0 - x1; }
byCoordinates = Vector.ByCoordinates(x=code_block_3)
translate = Geometry.Translate(geometry=startPoint, direction=byCoordinates, distance=code_block_3)
Y = Point.Y(point=endPoint)
Y_2 = Point.Y(point=startPoint)
code_block_4 = CodeBlock(y0=Y, y1=Y_2) { y0 - y1; }
byCoordinates_2 = Vector.ByCoordinates(y=code_block_4)
translate_2 = Geometry.Translate(geometry=startPoint, direction=byCoordinates_2, distance=code_block_4)
list_create = List.Create(item0=startPoint, item1=translate, item2=endPoint, item3=translate_2)
transpose = List.Transpose(lists=list_create)
byCornerPoints = Rectangle.ByCornerPoints(points=transpose)
height = Rectangle.Height(rectangle=byCornerPoints)
range = Range(start=code_block_2, end=height, step=code_block_2)
code_block_5 = CodeBlock { 0; }
getItemAtIndex = List.GetItemAtIndex(list=transpose@L2, index=code_block_5)
X_3 = Point.X(point=getItemAtIndex)
add = range@L2 + X_3@L1
width = Rectangle.Width(rectangle=byCornerPoints)
range_2 = Range(start=code_block_2, end=width, step=code_block_2)
Y_3 = Point.Y(point=getItemAtIndex)
add_2 = range_2@L2 + Y_3@L1
python_script = Python(IN[0]=add, IN[1]=add_2)  # CPython3
# ---------- python_script.python (46 lines) ----------
import sys
sys.path.append("C:\\Users\\dalto\\anaconda3\\envs\\Dynamo_210\\Lib")
sys.path.append("C:\\Users\\dalto\\OneDrive\\My Stuff\\GitHub\\All-Sorts-of-Dynamo-Scripts\\Python Module")

import clr

clr.AddReference('RevitAPI')
from Autodesk.Revit.DB import *
from Autodesk.Revit.DB.Structure import *

clr.AddReference('RevitAPIUI')
from Autodesk.Revit.UI import *

clr.AddReference('System')
from System.Collections.Generic import List

clr.AddReference('RevitNodes')
import Revit
clr.ImportExtensions(Revit.GeometryConversion)
clr.ImportExtensions(Revit.Elements)

clr.AddReference('RevitServices')
import RevitServices
from RevitServices.Persistence import DocumentManager
from RevitServices.Transactions import TransactionManager

doc = DocumentManager.Instance.CurrentDBDocument
uidoc=DocumentManager.Instance.CurrentUIApplication.ActiveUIDocument

#Preparing input from dynamo to revit
clr.AddReference('ProtoGeometry')
from Autodesk.DesignScript.Geometry import Point


x_lists = IN[0]
y_lists = IN[1]

OUT = []
for x_nums, y_nums in zip(x_lists, y_lists):
    points = []
    for x in x_nums:
        for y in y_nums:
            #create a point
            point = Point.ByCoordinates(x, y, 0)
            points.append(point)
    OUT.append(points)
# ----------------------------------------
byJoinedCurves = PolyCurve.ByJoinedCurves(curves=coreBoundary@L2)
identity = Object.Identity(object=byJoinedCurves)
startPoint_2 = Curve.StartPoint(curve=identity)
code_block_6 = CodeBlock { 2; }
pointsAtChordLengthFromPoint = Curve.PointsAtChordLengthFromPoint(curve=identity, point=startPoint_2, chordLength=code_block_6)
byPoints = Polygon.ByPoints(points=pointsAtChordLengthFromPoint)
containmentTest = Polygon.ContainmentTest(polygon=byPoints, point=python_script)
filterByBoolMask = List.FilterByBoolMask(list=python_script, mask=containmentTest)
identity_2 = Object.Identity(object=filterByBoolMask.in)
code_block_7 = CodeBlock(x=identity_2) { x[0]; }
identity_3 = Object.Identity(object=transpose)
code_block_8 = CodeBlock(x=identity_3) { x[0]; }
byStartPointEndPoint_2 = Line.ByStartPointEndPoint(startPoint=code_block_7@L1, endPoint=code_block_8@L2, lacing=CrossProduct)
code_block_9 = CodeBlock(x=byStartPointEndPoint_2) { x[0]; }
code_block_10 = CodeBlock { 0; }
getItemAtIndex_2 = List.GetItemAtIndex(list=identity_2@L2, index=code_block_10)
