# Dynamo graph Dynamo - Quick Sorting Example.dyn (Dynamo 2.12.0.5650)

python_script = Python()  # IronPython2; unwired: IN[0]
# ---------- python_script.python (1 lines) ----------
OUT = ["Loading 1",  "Loading 2",  "Loading 3", "Loading 4", "Loading 5", "Loading 6", "Loading 7", "Loading 8", "Loading 9", "Loading 10", "Loading 11", "Loading 12", "Loading 13", "Loading 14", "Loading 15", "Loading 1c", "Loading 2c", "Loading 3b", "Loading 3c"]
# ----------------------------------------
shuffle = List.Shuffle(list=python_script)
sort = List.Sort(list=shuffle)
python_script_2 = Python(IN[0]=sort)  # IronPython2
# ---------- python_script_2.python (19 lines) ----------
import re

def atoi(text):
    return int(text) if text.isdigit() else text

def natural_keys(text):
    '''
    alist.sort(key=natural_keys) sorts in human order
    http://nedbatchelder.com/blog/200712/human_sorting.html
    (See Toothy's implementation in the comments)
    '''
    return [ atoi(c) for c in re.split(r'(\d+)', text) ]

list = IN[0]

list.sort(key=natural_keys)
OUT = list

#https://stackoverflow.com/questions/5967500/how-to-correctly-sort-a-string-with-a-number-inside
# ----------------------------------------
