# Dynamo graph Replace Shared Parameters with Family Parameters.dyn "Refactored_Convert_Other_Shared_Params_To_Family_Params" (Dynamo 2.18.1.5096)
# packages: Orchid 217.0.0.5911

byName = Family.ByName()  # unwired: name
byCategory = Orchid.RevitProject.Elements.Family.ByCategory()  # unwired: category
code_block = CodeBlock { "Generic Models"; }
byName_2 = Category.ByName(name=code_block)
# note: Different ways to collect families.
all_elements_of_category = ElementsOfCategory(Category=byName_2)
getFamily = FamilyInstance.GetFamily(familyInstance=all_elements_of_category)
identity = Object.Identity(object=getFamily)
# note: Returns shared parameter objects and guids from the families
python_script = Python(IN[0]=identity)  # CPython3
# ---------- python_script.python (37 lines) ----------
import clr
clr.AddReference('RevitAPI')
from Autodesk.Revit.DB import *

# Import DocumentManager and TransactionManager
clr.AddReference("RevitServices")
import RevitServices
from RevitServices.Persistence import DocumentManager
from RevitServices.Transactions import TransactionManager

clr.AddReference("RevitServices")
import RevitServices
from RevitServices.Persistence import DocumentManager

doc = DocumentManager.Instance.CurrentDBDocument

families = UnwrapElement(IN[0])

def get_family_parameters(family):
    family_guids_and_parameters = [[],[]]
    family_doc = doc.EditFamily(family)
    parameters = family_doc.FamilyManager.GetParameters()

    for parameter in parameters:
        if parameter.IsShared:
            family_guids_and_parameters[0].append(parameter.GUID)
            family_guids_and_parameters[1].append(parameter)

    # Close the temporary family document
    #family_doc.Close(False)
    
    family_guids_and_parameters.append(family_doc)
    return family_guids_and_parameters

OUT = []
for family in families:
    OUT.append(get_family_parameters(family))
# ----------------------------------------
code_block_2 = CodeBlock { 1; }
# note: Family Parameter Objects
getItemAtIndex = List.GetItemAtIndex(list=python_script@L3, index=code_block_2)

# group: Shared Parameters from your txt file.
# note: Can use multiple files.
file_path = Filename(".\Company_SharedParameters.txt")
code_block_3 = CodeBlock(path=file_path) { path: string; }
fromPath = FileObject(path=code_block_3)  # "File.FromPath"
readText = FileSystem.ReadText(file=fromPath)
python_script_2 = Python(IN[0]=readText)  # CPython3
# ---------- python_script_2.python (28 lines) ----------
import clr
import re
groups = {}
guids = []
names = []
datatypes = []
datacategories = []
groupnames = []
visible = []
description = []
usermodifiable = []
for line in IN[0].splitlines():
	line = re.split(r'\t', line)
	if line[0] == "GROUP":
		groups[line[1]] = line[2]
	if line[0] == "PARAM":
		guids.append(line[1])
		names.append(line[2])
		datatypes.append(line[3])
		datacategories.append(line[4])
		groupnames.append(groups[line[5]])
		visible.append(line[6] == "1")
		# optional items (not present in all SP files)
		if len(line) > 7: description.append(line[7])
		else: description.append(None)
		if len(line) > 8: usermodifiable.append(line[8] == "1")
		else: usermodifiable.append(True)
OUT = names, guids, datatypes, datacategories, groupnames, description, visible, usermodifiable
# ----------------------------------------
code_block_4 = CodeBlock(x=python_script_2) { x[1]; }

code_block_5 = CodeBlock { 0; }
# note: GUIDs
getItemAtIndex_2 = List.GetItemAtIndex(list=python_script@L3, index=code_block_5)
# note: Finds third-party shared parameters in families and returns a bool list to be used by filter.
python_script_3 = Python(IN[0]=code_block_4, IN[1]=getItemAtIndex_2)  # CPython3
# ---------- python_script_3.python (18 lines) ----------
company_shared_parameters = IN[0]
families_shared_parameters = IN[1]


def find_other_shared_parameters(company_shared_parameters, family_shared_parameters):
    check_bools = []
    for family_shared_parameter in family_shared_parameters:
        check = False
        for company_shared_parameter in company_shared_parameters:
            if str(family_shared_parameter) == str(company_shared_parameter):
                check = True
                break
        check_bools.append(check)
    return check_bools
 
OUT = []
for family_shared_parameters in families_shared_parameters:   
    OUT.append(find_other_shared_parameters(company_shared_parameters, family_shared_parameters))        
# ----------------------------------------
filterByBoolMask = List.FilterByBoolMask(list=getItemAtIndex@L2, mask=python_script_3@L2)
# note: Used to filter out the families that don't have third-party parameters.
isEmpty = List.IsEmpty(list=filterByBoolMask.out@L2)
filterByBoolMask_2 = List.FilterByBoolMask(list=identity, mask=isEmpty)
watch = Watch(filterByBoolMask_2.out)
code_block_6 = CodeBlock { 2; }
getItemAtIndex_3 = List.GetItemAtIndex(list=python_script@L3, index=code_block_6)
filterByBoolMask_3 = List.FilterByBoolMask(list=getItemAtIndex_3, mask=isEmpty)
filterByBoolMask_4 = List.FilterByBoolMask(list=filterByBoolMask.out, mask=isEmpty)
save_family_out = Python(IN[0]=filterByBoolMask_3.out, IN[1]=filterByBoolMask_4.out)  # CPython3
# ---------- save_family_out.python (80 lines) ----------
#The BIM Coordinators Dynamo Python Template
#Subscribe to my YouTube: https://www.youtube.com/c/TheBIMCoordinator/featured
#Follow my on LinkedIn: https://www.linkedin.com/in/dalton-goodwin-067a07107/

"""
Dynamo Core Assemblies: 
https://www.nuget.org/packages/DynamoVisualProgramming.Core/2.13.1.3887

Revit API: 
https://www.revitapidocs.com/2020/d4648875-d41a-783b-d5f4-638df39ee413.htm
"""

"""
C:\Program Files\Autodesk\Revit 2022\AddIns\DynamoForRevit

C:\Program Files\Autodesk\Revit 2022\AddIns\DynamoForRevit\Revit

"""




import clr
clr.AddReference('RevitAPI')
from Autodesk.Revit.DB import *

# Import DocumentManager and TransactionManager
clr.AddReference("RevitServices")
import RevitServices
from RevitServices.Persistence import DocumentManager
from RevitServices.Transactions import TransactionManager

clr.AddReference("RevitServices")
import RevitServices
from RevitServices.Persistence import DocumentManager

from Autodesk.Revit.DB import Transaction, Family

doc = DocumentManager.Instance.CurrentDBDocument

# Unwrap input elements from Dynamo
input_family_docs = UnwrapElement(IN[0])
input_family_parameters = UnwrapElement(IN[1])

# Prepare output list
OUT = []

# Function to replace family parameter
def replace_parameter(fam_doc, param, new_name, is_instance):
    try:
        trans = Transaction(fam_doc, 'UpdateParam')
        trans.Start()
        new_param = fam_doc.FamilyManager.ReplaceParameter(param, new_name, param.Definition.ParameterGroup, is_instance)
        trans.Commit()
        return new_param
    except Exception as e:
        trans.RollBack()
        print(f"Failed to replace parameter: {e}")
        return None

# Iterate through each family and its corresponding parameters
for fam_doc, family_parameters in zip(input_family_docs, input_family_parameters):
    # Iterate through each parameter to replace
    for param in family_parameters:
        param_name = param.Definition.Name
        is_instance = param.IsInstance
        new_param = replace_parameter(fam_doc, param, f"{param_name}_UPDATED", is_instance)
        if new_param is None:
            OUT.append(f"Failed to replace parameter '{param_name}' in family '{fam_doc.Title}'")
    # Save and close the Family document
    #fam_doc.SaveAs(f"{fam_doc.Title}_UPDATED.rfa")
    #fam_doc.Close(False)
    OUT.append(fam_doc)




  

 
# ----------------------------------------
await_ = Orchid.Common.DataStream.Await(pass=watch, waitFor=save_family_out)
familyDocument = Family.FamilyDocument(family=await_)
load = Orchid.RevitProject.Elements.Family.Load(familyDocument=familyDocument)
