# Dynamo graph Dynamo - Tag Leader Location.dyn (Dynamo 2.12.0.5650)

code_block = CodeBlock { "Room Tags"; }
byName = Category.ByName(name=code_block)
current = Document.Current()
activeView = Document.ActiveView(document=current)
all_elements_of_category_in_view = ElementsOfCategoryInView(Category=byName, View=activeView)
# note: 1 = 306 - 56
# 2 = 56 - 144
# 3 = 144 - 216
# 4 = 216 -306
python_script = Python(IN[0]=all_elements_of_category_in_view)  # IronPython2
# ---------- python_script.python (150 lines) ----------
"""
Dynamo Core Assemblies: 
https://www.nuget.org/packages/DynamoVisualProgramming.Core/2.13.1.3887

Revit API: 
https://www.revitapidocs.com/2020/d4648875-d41a-783b-d5f4-638df39ee413.htm
"""

"""
C:\Program Files\Autodesk\Revit 2022\AddIns\DynamoForRevit

C:\Program Files\Autodesk\Revit 2022\AddIns\DynamoForRevit\Revit

"""


import sys
sys.path.append("C:\\Users\\dalto\\anaconda3\\envs\\Dynamo_2022\\Lib")
sys.path.append("C:\\Users\\dalto\\OneDrive\\My Stuff\\GitHub\\All-Sorts-of-Dynamo-Scripts\\Python Module")

import clr

clr.AddReference('ProtoGeometry')
from Autodesk.DesignScript.Geometry import Vector, Line


#clr.AddReference('RevitAPIUI')
#from Autodesk.Revit.UI import *

#clr.AddReference('System')
#from System.Collections.Generic import List

clr.AddReference('RevitNodes')
import Revit
clr.ImportExtensions(Revit.GeometryConversion)
#clr.ImportExtensions(Revit.Elements)

clr.AddReference('RevitServices')
import RevitServices
from RevitServices.Persistence import DocumentManager
from RevitServices.Transactions import TransactionManager

doc = DocumentManager.Instance.CurrentDBDocument
#uidoc=DocumentManager.Instance.CurrentUIApplication.ActiveUIDocument

#Preparing input from dynamo to revit
elements = UnwrapElement(IN[0])



# Revit Dynamo Python Node
# Check what quadrant a leader line is so that we assign the correct type

def get_direction_of_leader_line(room_tag):
    #create line
    line = Line.ByStartPointEndPoint(room_tag.LeaderElbow.ToPoint(), room_tag.TagHeadPosition.ToPoint())
    return line.Direction

#def get_quadrant_of_leader_line(line):


#get vector angle
def get_vector_angle(room_tag):
    #get vector angle
    vect = Vector.ByCoordinates(0,-1,0)
    other_vect = get_direction_of_leader_line(room_tag)
    rotation_axis = Vector.ByCoordinates(0,0,1)
    angle = Vector.AngleAboutAxis(vect,other_vect,rotation_axis)
    return angle
    


def get_quadrant_of_leader_line(room_tag):

    #Get quadrant of leader line
    """
    Quadrants are defined as follows:
    1 = 306 - 56
    2 = 56 - 144
    3 = 144 - 216
    4 = 216 -306
    """
    angle = int(get_vector_angle(room_tag))
    degree_list = tuple(range(1,361))
    one = degree_list[305:]+degree_list[:55]
    two = degree_list[55:143]
    three = degree_list[143:215]
    four = degree_list[215:305]
    quadrant = 0
    if angle in one:
        quadrant = 1
    elif angle in two:
        quadrant = 2
    elif angle in three:
        quadrant = 3
    elif angle in four:
        quadrant = 4
    return quadrant



def line_count(tag):
    strings = tag.TagText.split(" ")
    first_line = strings.pop(0)
    lines = [[first_line]]
    counter = 0
    while strings:
        if len(" ".join(lines[counter])+strings[0])< 18:
            lines[counter].append(strings.pop(0))
        else:
            counter += 1
            lines.append(list())
            lines[counter].append(strings.pop(0))
            
    return len(lines)
 

multi_line_tags = []
tags = []

for tag in elements:
	if line_count(tag) < 2:
		tags.append(tag)
	else:
		multi_line_tags.append(tag)
		
"""
strings = element.TagText.split(" ")

strings = line_count(strings)

total = strings + strings-2
text_size = 0.125
total * text_size
"""

OUT = [[],[],[],[],[]]
for tag in tags:
	if tag.HasLeader:
		OUT[0].append(get_quadrant_of_leader_line(tag))
		OUT[1].append(tag)

for tag in multi_line_tags:
	if "h" in tag.Name:
		pass
	else:
		if tag.HasLeader:
			OUT[2].append(get_quadrant_of_leader_line(tag))
			OUT[3].append(tag)
			OUT[4].append(line_count(tag))
# ----------------------------------------
code_block_2 = CodeBlock(x=python_script) { x[1]; x[0]; }
code_block_3 = CodeBlock { "Type"; }
code_block_4 = CodeBlock(x=code_block_2.out1) { x == 3; }
family_types = FamilyTypes("Room Tag:Room Tag 2")
family_types_2 = FamilyTypes("Room Tag:Room Tag")
if_ = RefactoredIf(test=code_block_4, true=family_types, false=family_types_2)
setParameterByName = Element.SetParameterByName(element=code_block_2.out0, parameterName=code_block_3, value=if_)
code_block_5 = CodeBlock(x=python_script) { x[2]; x[3]; x[4]; }
code_block_6 = CodeBlock { "Type"; }
code_block_7 = CodeBlock(x=code_block_5.out0) { x == 3; }
family_types_3 = FamilyTypes("Room Tag:Room Tag 2")
code_block_8 = CodeBlock { []; }
if_2 = RefactoredIf(test=code_block_7, true=family_types_3, false=code_block_8)
code_block_9 = CodeBlock { 1; 1; }
filterByBoolMask = List.FilterByBoolMask(list=code_block_5.out1, mask=code_block_7)
count = List.Count(list=filterByBoolMask.out)
range = Range(start=code_block_9.out0, end=count, step=code_block_9.out1)
now = DateTime.Now()
dayOfYear = DateTime.DayOfYear(dateTime=now)
random = Math.Random(value1=range, value2=dayOfYear)
floor = Math.Floor(number=random)
string_from_object = FromObject(object=floor)
family_types_4 = FamilyTypes("Room Tag:Room Tag 2")
name = Element.Name(element=family_types_4)
code_block_10 = CodeBlock(num=string_from_object, tag=name) { "h_" + num + "_" + tag; }
duplicate = ElementType.Duplicate(elementType=family_types_4, name=code_block_10)
code_block_11 = CodeBlock(passthrough=code_block_10, waitfor=duplicate) { [passthrough,waitfor][0]; }
byName_2 = FamilyType.ByName(name=code_block_11)
code_block_12 = CodeBlock { "Left/Right"; }
filterByBoolMask_2 = List.FilterByBoolMask(list=code_block_5.out2, mask=code_block_7)
code_block_13 = CodeBlock(x=filterByBoolMask_2.out) { x + x-2; }
code_block_14 = CodeBlock(x=code_block_13) { x  * 0.013; }
setParameterByName_2 = Element.SetParameterByName(element=byName_2, parameterName=code_block_12, value=code_block_14)
python_script_2 = Python(IN[0]=if_2, IN[1]=setParameterByName_2)  # IronPython2
# ---------- python_script_2.python (29 lines) ----------
"""
Dynamo Core Assemblies: 
https://www.nuget.org/packages/DynamoVisualProgramming.Core/2.13.1.3887

Revit API: 
https://www.revitapidocs.com/2020/d4648875-d41a-783b-d5f4-638df39ee413.htm
"""

"""
C:\Program Files\Autodesk\Revit 2022\AddIns\DynamoForRevit

C:\Program Files\Autodesk\Revit 2022\AddIns\DynamoForRevit\Revit

"""




#Preparing input from dynamo to revit
types = IN[0]

other_types = IN[1]
counter = 0
for index, type in enumerate(types):
	if type == []:
		types[index] = other_types[counter]
		counter += 1

OUT = types
# ----------------------------------------
setParameterByName_3 = Element.SetParameterByName(element=code_block_5.out1, parameterName=code_block_6, value=python_script_2)
