# Dynamo graph Tab Select Duct Path and Selection Sets.dyn "selection path" (Dynamo 2.18.1.5096)

boolean = BoolSelector(false)
python_script_returns_elements = Python(IN[0]=boolean)  # "Python Script - Returns Elements of Active Selection"; CPython3
# ---------- python_script_returns_elements.python (35 lines) ----------
#The BIM Coordinators Dynamo Python Template
#Subscribe to my YouTube Channel: https://www.youtube.com/c/TheBIMCoordinator/featured
#Follow me on LinkedIn: https://www.linkedin.com/in/dalton-goodwin-067a07107/

"""
Dynamo Core Assemblies: 
https://www.nuget.org/packages/DynamoVisualProgramming.Core/2.13.1.3887

Revit API: 
https://www.revitapidocs.com/2020/d4648875-d41a-783b-d5f4-638df39ee413.htm
"""

"""
C:\Program Files\Autodesk\Revit 2022\AddIns\DynamoForRevit

C:\Program Files\Autodesk\Revit 2022\AddIns\DynamoForRevit\Revit

"""

import clr

clr.AddReference('RevitAPIUI')
from Autodesk.Revit.UI import Selection

clr.AddReference('RevitServices')
import RevitServices
from RevitServices.Persistence import DocumentManager

doc = DocumentManager.Instance.CurrentDBDocument
uidoc=DocumentManager.Instance.CurrentUIApplication.ActiveUIDocument


OUT = []
for id in uidoc.Selection.GetElementIds():
    OUT.append(doc.GetElement(id))
# ----------------------------------------
code_block = CodeBlock { "test3"; }
# note: Clockwork
python_script_create = Python(IN[0]=python_script_returns_elements, IN[1]=code_block)  # "Python Script - Create SelectionSet"; CPython3
# ---------- python_script_create.python (45 lines) ----------
import clr
clr.AddReference('RevitAPI')
from Autodesk.Revit.DB import *
from System.Collections.Generic import *

clr.AddReference("RevitNodes")
import Revit
clr.ImportExtensions(Revit.Elements)

clr.AddReference("RevitServices")
import RevitServices
from RevitServices.Persistence import DocumentManager
from RevitServices.Transactions import TransactionManager

doc = DocumentManager.Instance.CurrentDBDocument
name = IN[1]

# create itemset
items = UnwrapElement(IN[0])
ids = list()
for item in items:
	ids.append(item.Id)
itemset = List[ElementId](ids)

# collect all existing filters from the model 
names = list()
collector = FilteredElementCollector(doc)
filters = collector.OfClass(FilterElement).ToElements();

selset = False
TransactionManager.Instance.EnsureInTransaction(doc)
# if a filter of that name already exists, delete its content
for filter in filters:
	if filter.Name == name:
		filter.Clear()
		selset = filter
# create a new selection set if it doesn't already exist
if selset == False:
	selset = SelectionFilterElement.Create(doc,name)
# add the items to the selection set
try: 
	selset.AddSet(itemset)
	OUT = selset.ToDSType(False)
except: OUT = None
TransactionManager.Instance.TransactionTaskDone()
# ----------------------------------------
boolean_2 = BoolSelector(true)
python_script_returns_all_saved = Python(IN[0]=boolean_2)  # "Python Script - Returns All Saved SelectionSets"; CPython3
# ---------- python_script_returns_all_saved.python (16 lines) ----------
import clr
clr.AddReference('RevitAPI')
from Autodesk.Revit.DB import FilteredElementCollector, SelectionFilterElement

clr.AddReference("RevitServices")
from RevitServices.Persistence import DocumentManager

doc = DocumentManager.Instance.CurrentDBDocument


collector = FilteredElementCollector(doc)
selection_sets = collector.OfClass(SelectionFilterElement).ToElements()

selection_set_names = [sel_set.Name for sel_set in selection_sets]

OUT = selection_set_names, selection_sets
# ----------------------------------------
code_block_2 = CodeBlock(x=python_script_returns_all_saved) { x[1]; }
python_script_returns_elements_2 = Python(IN[0]=code_block_2)  # "Python Script - Returns Elements in SelectionSet"; CPython3
# ---------- python_script_returns_elements_2.python (12 lines) ----------
import clr
clr.AddReference('RevitAPI')
from Autodesk.Revit.DB import *

items = UnwrapElement(IN[0])
elementlist = list()
for item in items:
	selsetmembers = list()
	for member in item.GetElementIds():
		selsetmembers.append(item.Document.GetElement(member))
	elementlist.append(selsetmembers)
OUT = elementlist
# ----------------------------------------
