# Dynamo graph Tab Select Elements.dyn (Dynamo 2.12.0.5650)

# note: https://forum.dynamobim.com/t/how-to-force-nodes-to-rerun-without-changes-when-nodes-rerun/56366/3
force_get_active_selection = Python()  # IronPython2
# ---------- force_get_active_selection.python (38 lines) ----------
import clr

clr.AddReference('RevitAPI')
from Autodesk.Revit.DB import *
from Autodesk.Revit.DB.Structure import *

clr.AddReference('RevitAPIUI')
from Autodesk.Revit.UI import *

clr.AddReference('RevitAPIUI')
from Autodesk.Revit.UI import Selection

clr.AddReference('System')
from System.Collections.Generic import List

clr.AddReference('RevitNodes')
import Revit
clr.ImportExtensions(Revit.GeometryConversion)
clr.ImportExtensions(Revit.Elements)

clr.AddReference('RevitServices')
import RevitServices
from RevitServices.Persistence import DocumentManager
from RevitServices.Transactions import TransactionManager

doc = DocumentManager.Instance.CurrentDBDocument
uidoc=DocumentManager.Instance.CurrentUIApplication.ActiveUIDocument


def get_current_selection (uidoc):
	sel = uidoc.Selection
	return sel.GetElementIds()
	
selected_elements = []
for i in get_current_selection(uidoc):
	selected_elements.append(doc.GetElement(i))

OUT = selected_elements
# ----------------------------------------
python_script = Python()  # IronPython2
# ---------- python_script.python (16 lines) ----------
import clr
clr.AddReference('ProtoGeometry')
from Autodesk.DesignScript.Geometry import *

clr.AddReference('DynamoRevitDS')
import Dynamo
#access to the current Dynamo instance and workspace
dynamoRevit = Dynamo.Applications.DynamoRevit()
currentWorkspace = dynamoRevit.RevitDynamoModel.CurrentWorkspace

def onEvaluationcompleted(obj, e):
	for i in currentWorkspace.Nodes:
		if i.Name.StartsWith("*Force"):
			i.MarkNodeAsModified(True)
#the handlers for when a script has been run
currentWorkspace.EvaluationCompleted += onEvaluationcompleted
# ----------------------------------------
python_script_2 = Python()  # IronPython2; unwired: IN[0]
# ---------- python_script_2.python (46 lines) ----------
"""
Dynamo Core Assemblies: 
https://www.nuget.org/packages/DynamoVisualProgramming.Core/2.13.1.3887

Revit API: 
https://www.revitapidocs.com/2020/d4648875-d41a-783b-d5f4-638df39ee413.htm
"""

import sys
sys.path.append("C:\\Users\\dalto\\anaconda3\\envs\\Dynamo_2022\\Lib")
sys.path.append("C:\\Users\\dalto\\OneDrive\\My Stuff\\GitHub\\All-Sorts-of-Dynamo-Scripts\\Python Module")

import clr

clr.AddReference('RevitAPI')
from Autodesk.Revit.DB import *
from Autodesk.Revit.DB.Structure import *

clr.AddReference('RevitAPIUI')
from Autodesk.Revit.UI import *

clr.AddReference('System')
from System.Collections.Generic import List

clr.AddReference('RevitNodes')
import Revit
clr.ImportExtensions(Revit.GeometryConversion)
clr.ImportExtensions(Revit.Elements)

clr.AddReference('RevitServices')
import RevitServices
from RevitServices.Persistence import DocumentManager
from RevitServices.Transactions import TransactionManager

doc = DocumentManager.Instance.CurrentDBDocument
uidoc=DocumentManager.Instance.CurrentUIApplication.ActiveUIDocument

#Preparing input from dynamo to revit
element = UnwrapElement(IN[0])

#Do some action in a Transaction
TransactionManager.Instance.EnsureInTransaction(doc)

TransactionManager.Instance.TransactionTaskDone()

OUT = element
# ----------------------------------------
