# Dynamo graph Workset Assignment by Category Automated.dyn (Dynamo 2.12.0.5650)

model_categories = Python()  # IronPython2; unwired: IN[0]
# ---------- model_categories.python (41 lines) ----------
#The BIM Coordinators Dynamo Python Template
#Subscribe to my YouTube: https://www.youtube.com/c/TheBIMCoordinator/featured
#Follow my on LinkedIn: https://www.linkedin.com/in/dalton-goodwin-067a07107/

"""
Dynamo Core Assemblies: 
https://www.nuget.org/packages/DynamoVisualProgramming.Core/2.13.1.3887

Revit API: 
https://www.revitapidocs.com/2020/d4648875-d41a-783b-d5f4-638df39ee413.htm
"""

"""
C:\Program Files\Autodesk\Revit 2022\AddIns\DynamoForRevit

C:\Program Files\Autodesk\Revit 2022\AddIns\DynamoForRevit\Revit

"""

import clr

clr.AddReference('RevitAPI')
from Autodesk.Revit.DB import Category, FilteredElementCollector 


clr.AddReference('RevitServices')
import RevitServices
from RevitServices.Persistence import DocumentManager
from RevitServices.Transactions import TransactionManager


doc = DocumentManager.Instance.CurrentDBDocument

OUT = set()
collector = FilteredElementCollector(doc).WhereElementIsNotElementType()

for ele in list(collector):
	if ele.Category:
		if ele.Category.CategoryType.ToString() == 'Model':
			if ele.Category.CanAddSubcategory:
				OUT.add(ele.Category.Name)
# ----------------------------------------
userWorksets = Python()  # IronPython2; unwired: IN[0]
# ---------- userWorksets.python (38 lines) ----------
#The BIM Coordinators Dynamo Python Template
#Subscribe to my YouTube: https://www.youtube.com/c/TheBIMCoordinator/featured
#Follow my on LinkedIn: https://www.linkedin.com/in/dalton-goodwin-067a07107/

"""
Dynamo Core Assemblies: 
https://www.nuget.org/packages/DynamoVisualProgramming.Core/2.13.1.3887

Revit API: 
https://www.revitapidocs.com/2020/d4648875-d41a-783b-d5f4-638df39ee413.htm
"""

"""
C:\Program Files\Autodesk\Revit 2022\AddIns\DynamoForRevit

C:\Program Files\Autodesk\Revit 2022\AddIns\DynamoForRevit\Revit

"""

import clr

clr.AddReference('RevitAPI')
from Autodesk.Revit.DB import FilteredWorksetCollector

clr.AddReference('RevitServices')
import RevitServices
from RevitServices.Persistence import DocumentManager


doc = DocumentManager.Instance.CurrentDBDocument

OUT = [[], []]
collector = FilteredWorksetCollector(doc)
for workset in collector:
	if str(workset.Kind) == 'UserWorkset':
		OUT[0].append(workset.Id.IntegerValue)
		OUT[1].append(workset.Name)
	
# ----------------------------------------
python_script = Python(IN[0]=model_categories, IN[1]=userWorksets)  # CPython3
# ---------- python_script.python (46 lines) ----------
#The BIM Coordinators Dynamo Python Template
#Subscribe to my YouTube: https://www.youtube.com/c/TheBIMCoordinator/featured
#Follow my on LinkedIn: https://www.linkedin.com/in/dalton-goodwin-067a07107/

"""
Dynamo Core Assemblies: 
https://www.nuget.org/packages/DynamoVisualProgramming.Core/2.13.1.3887

Revit API: 
https://www.revitapidocs.com/2020/d4648875-d41a-783b-d5f4-638df39ee413.htm
"""

"""
C:\Program Files\Autodesk\Revit 2022\AddIns\DynamoForRevit

C:\Program Files\Autodesk\Revit 2022\AddIns\DynamoForRevit\Revit

"""


import sys
sys.path.append("C:\\Users\\dalto\\anaconda3\\envs\\Dynamo_2022\\Lib\\site-packages")



model_categories = IN[0]

user_workset_ids = IN[1][0]
user_workset_names = IN[1][1]


#from Levenshtein import distance as lev
from Levenshtein import distance as lev
from fuzzywuzzy import fuzz
from fuzzywuzzy import process

OUT = []
fuzz_values = []
for cat in model_categories:
    fuzz_ratios = []
    for workset in user_workset_names:
        fuzz_ratios.append(fuzz.ratio(cat, workset))
    fuzz_values.append(fuzz_ratios)
for ind, i in enumerate(fuzz_values):
    if max(i) > 80:
        OUT.append([user_workset_names[i.index(max(i))], user_workset_ids[i.index(max(i))], model_categories[ind]])
# ----------------------------------------
code_block = CodeBlock { 2; }
getItemAtIndex = List.GetItemAtIndex(list=python_script@L2, index=code_block)
byName = Category.ByName(name=getItemAtIndex)
all_elements_of_category = ElementsOfCategory(Category=byName)
code_block_2 = CodeBlock { 1; }
getItemAtIndex_2 = List.GetItemAtIndex(list=python_script@L2, index=code_block_2)

# group: Assign Workset
code_block_3 = CodeBlock { "Workset"; }
setParameterByName = Element.SetParameterByName(element=all_elements_of_category, parameterName=code_block_3, value=getItemAtIndex_2)
