# Dynamo graph Dynamo - Workset Assignment.dyn (Dynamo 2.10.1.3976)

select_model_elements = DSModelElementsSelection()  # 2959 picked in the model
python_script = Python(IN[0]=select_model_elements)  # CPython3
# ---------- python_script.python (131 lines) ----------
import sys
sys.path.append("C:\\Users\\dalto\\anaconda3\\envs\\Dynamo_210\\Lib")
sys.path.append("C:\\Users\\dalto\\OneDrive\\My Stuff\\GitHub\\All-Sorts-of-Dynamo-Scripts\\Python Module")

import clr

clr.AddReference('RevitAPI')
from Autodesk.Revit.DB import *
from Autodesk.Revit.DB.Structure import *

clr.AddReference('RevitAPIUI')
from Autodesk.Revit.UI import *

clr.AddReference('System')
from System.Collections.Generic import List

clr.AddReference('RevitNodes')
import Revit
clr.ImportExtensions(Revit.GeometryConversion)
clr.ImportExtensions(Revit.Elements)

clr.AddReference('RevitServices')
import RevitServices
from RevitServices.Persistence import DocumentManager
from RevitServices.Transactions import TransactionManager

doc = DocumentManager.Instance.CurrentDBDocument
uidoc=DocumentManager.Instance.CurrentUIApplication.ActiveUIDocument


#Do some action in a Transaction
TransactionManager.Instance.EnsureInTransaction(doc)

TransactionManager.Instance.TransactionTaskDone()
#Create new worksets in Revit
#Preparing input
elements = UnwrapElement(IN[0])

#check to see if input is a list and if it is, return list and if not return list
def check_list(input):
    if isinstance(input, list):
        return input
    else:
        return [input]

elements = check_list(elements)

#get all user worksets from doc and return list
def return_user_worksets(doc):
    collector = FilteredWorksetCollector(doc)
    worksets = collector.ToWorksets()
    user_worksets = []
    for i in worksets:
        if i.Kind == WorksetKind.UserWorkset:
            user_worksets.append(i)
    return user_worksets

#create new worksets in Revit
def create_workset(doc, name):
    ws = Workset.Create(doc, name)
    return ws.Name

#clean up strings for workset creation
def clean_string(string):
    string = string.replace(' ', '_')
    string = string.replace('/', '_')
    string = string.replace('\\', '_')
    string = string.replace('-', '_')
    string = string.replace('(', '_')
    string = string.replace(')', '_')
    string = string.replace('.', '_')
    string = string.replace('&', '_')
    string = string.replace('%', '_')
    string = string.replace('#', '_')
    string = string.replace('!', '_')
    string = string.replace('@', '_')
    string = string.replace('$', '_')
    string = string.replace('^', '_')
    string = string.replace('*', '_')
    string = string.replace('+', '_')
    string = string.replace('=', '_')
    string = string.replace('~', '_')
    string = string.replace('`', '_')
    string = string.replace('<', '_')
    string = string.replace('>', '_')
    string = string.replace('?', '_')
    string = string.replace('|', '_')
    string = string.replace('{', '_')
    string = string.replace('}', '_')
    return string 

all_categories = []
for i in elements:
	all_categories.append(clean_string(i.Category.Name))
all_categories = set(all_categories)


#check to see if workset exists
def check_workset(doc, name, worksets):
    for i in worksets:
        if i.Name == name:
            return True
    return False
    

#create workset from element category name
def create_workset_from_category(doc, all_categories):
    worksets = return_user_worksets(doc)
    new_worksets = []
    for workset_name in all_categories:
        if check_workset(doc, workset_name, worksets) == False:
            workset = create_workset(doc, workset_name)
            new_worksets.append(workset)
    return new_worksets

#set worksets for elements
def set_workset(doc, elements):
    worksets = return_user_worksets(doc)
    for i in elements:
        #check to see if element workset property is read only
        for p in i.GetOrderedParameters():
            if p.Definition.Name == "Workset":
                if p.IsReadOnly == False:
                    for j in worksets:
                        if clean_string(i.Category.Name) == j.Name:
                            i.get_Parameter(BuiltInParameter.ELEM_PARTITION_PARAM).Set(int(j.Id.ToString()))
                            break
                
    return elements
    
OUT = create_workset_from_category(doc, all_categories), set_workset(doc, elements)
# ----------------------------------------
