# Dynamo graph pinning sheets.dyn (Dynamo 2.17.0.3472)

code_block = CodeBlock { "Sheets"; }
byName = Category.ByName(name=code_block)
all_elements_of_category = ElementsOfCategory(Category=byName)
isPinned = Element.IsPinned(element=all_elements_of_category)
filterByBoolMask = List.FilterByBoolMask(list=all_elements_of_category, mask=isPinned)
watch = Watch(filterByBoolMask.in)
boolean = BoolSelector(false)
setPinnedStatus = Element.SetPinnedStatus(element=watch, pinned=boolean)
