# Dynamo graph ChatGPT Code.dyn "ChatGPT Test" (Dynamo 2.12.1.8246)

code_block = CodeBlock { "Walls"; }
byName = Category.ByName(name=code_block)
all_elements_of_category = ElementsOfCategory(Category=byName)
code_block_2 = CodeBlock { "Mark"; }
code_block_3 = CodeBlock { 1; }
count = List.Count(list=all_elements_of_category)  # frozen
range = Range(start=code_block_3, end=count)
string_from_object = FromObject(object=range)
setParameterByName = Element.SetParameterByName(element=all_elements_of_category, parameterName=code_block_2, value=string_from_object)
code_block_4 = CodeBlock { "Mark"; }
getParameterValueByName = Element.GetParameterValueByName(element=setParameterByName, parameterName=code_block_4)
dynamo_to_chatgpt_to_python = Python()  # IronPython2; frozen; unwired: IN[0]
# ---------- dynamo_to_chatgpt_to_python.python (32 lines) ----------
import clr
import System

clr.AddReference('RevitAPI')
from Autodesk.Revit.DB import *

clr.AddReference('RevitServices')
from RevitServices.Persistence import DocumentManager
from RevitServices.Transactions import TransactionManager

# Get the current Revit document
doc = DocumentManager.Instance.CurrentDBDocument

# Get the category
category_name = 'OST_Walls'  # Replace with the desired built-in category
category = System.Enum.Parse(BuiltInCategory, category_name)

# Get elements of the specified category from the model
collector = FilteredElementCollector(doc).OfCategory(category)

# Start a transaction
TransactionManager.Instance.EnsureInTransaction(doc)

# Loop through elements and modify a parameter
parameter_name = 'Mark'  # Replace with the desired parameter name
for element in collector:
    param = element.LookupParameter(parameter_name)
    if param:
        param.Set('New Value')  # Replace with the desired value

# Finish the transaction
TransactionManager.Instance.TransactionTaskDone()
# ----------------------------------------
draw_io_to_chatgpt_to_python = Python()  # IronPython2; unwired: IN[0]
# ---------- draw_io_to_chatgpt_to_python.python (45 lines) ----------
# Import RevitAPI
import clr
clr.AddReference('RevitAPI')
import Autodesk
from Autodesk.Revit.DB import FilteredElementCollector, BuiltInCategory, Transaction, ParameterValueProvider, FilterStringEquals, ElementId, FilterStringRule, ElementParameterFilter

# Import DocumentManager and TransactionManager
clr.AddReference('RevitServices')
import RevitServices
from RevitServices.Persistence import DocumentManager
from RevitServices.Transactions import TransactionManager

doc = DocumentManager.Instance.CurrentDBDocument

# Create a collector instance and apply a filter for walls
collector = FilteredElementCollector(doc).OfCategory(BuiltInCategory.OST_Walls).WhereElementIsNotElementType()

# Define the parameter name
parameter_name = 'Mark'

# Collect all walls with the parameter 'Mark'
walls = []
for wall in collector:
    if wall.LookupParameter(parameter_name) is not None:
        walls.append(wall)

modified_elements = []

TransactionManager.Instance.EnsureInTransaction(doc)

counter = 1
for wall in walls:
    try:
        mark_param = wall.LookupParameter(parameter_name)
        if mark_param:
            mark_param.Set(str(counter))
            modified_elements.append(wall)
            counter += 1
    except Exception as e:
        pass

TransactionManager.Instance.TransactionTaskDone()

# Output
OUT = modified_elements
# ----------------------------------------
